# Grasshopper definition Stadium Definition_Linear.ghx (Grasshopper 1.0.7)

perimeter_of_bowl = Curve(<curve referenced from the Rhino model>)
int0_amount_of_deviations_on_each_side = Slider(13, range=5..51)
db0_offsetsides = Slider(1, range=0.1..50)
origincutting_plane = Point(<point referenced from the Rhino model>)
ring_1 = Curve(<curve referenced from the Rhino model>)
ring2 = Curve(<curve referenced from the Rhino model>)
centr = Curve(<curve referenced from the Rhino model>)
db0_scalecentr = Slider(0.9, range=0.1..0.9)
cluster = Cluster_3(
    int=int0_amount_of_deviations_on_each_side,
    ring_1=ring_1,
    ring2=ring2,
    centr=centr,
    num=db0_scalecentr,
    pt=origincutting_plane,
    num_2=db0_offsetsides,
    crv=perimeter_of_bowl)  # -> int_5, pt_7, pt_6, line_16, line_15, line_14, line_17, line_18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
attribute = Slider(0, range=-20..20)

# ---- group: Trails
trail_ring1 = Line(cluster.line_16)
trail_ring1_2 = Line(cluster.line_15)
trail_ring2 = Line(cluster.line_14)
trail_ring2_2 = Line(cluster.line_17)
trail_centrline = Line(cluster.line_21)
trail_centrline_2 = Line(cluster.line_18)
trail_centrline_3 = Line(cluster.line_19)
attribute_2 = Slider(-15, range=-20..10)
attribute_3 = Slider(0, range=-20..10)
attribute_4 = Slider(-15, range=-20..20)
python = GhPythonScript(Line=flatten([trail_ring1, trail_ring1_2]), Attribute=attribute_2)  # -> out, lines, attributes; inputs Line: list of Line
# ---------- python: Python ----------
__author__ = "opatrick"
__version__ = "2018.09.14"

import rhinoscriptsyntax as rs
lines = []
attributes = []

for i in xrange(0,len(Line),1):
    if Attribute != 0:
        lines.append(Line[i])
        attributes.append(Attribute)
# ---------- end python ----------
python_2 = GhPythonScript(Line=flatten([trail_ring2, trail_ring2_2]), Attribute=attribute)  # -> out, lines, attributes; inputs Line: list of Line; same code as python
python_3 = GhPythonScript(Line=flatten([trail_centrline_2, trail_centrline, trail_centrline_3]), Attribute=attribute_4)  # -> out, lines, attributes; inputs Line: list of Line; same code as python
python_4 = GhPythonScript(Line=flatten(cluster.perimeter_of_bowl_2), Attribute=attribute_3)  # -> out, lines, attributes; inputs Line: list of Line; same code as python

# ----
pt1_ring1 = Point(cluster.pt_7)
pt1_ring2 = Point(cluster.pt_6)
load_x = Slider(0, range=0..1)
load_x_2 = Slider(0, range=0..1)
load_x_3 = Slider(-16.686, range=-20..1)
int = Integer(cluster.int_5)
division = Division(A=load_x_3, B=int)
concat = Concatenate(FragmentA=load_x, FragmentB=",", FragmentC=load_x_2, FragmentD=",", FragmentE=division)
line = LineSDL(Start=flatten([pt1_ring1, pt1_ring2]), Direction=Vector(0, 0, 1), Length=1)
panel = Panel(concat)
lng = ListLength(List=line)
dup = DuplicateData(Data=concat, Number=lng, Order=True)

# ---- group: Deviation between trails and bowl
dev_1_bowl = Line(cluster.dev_1_bowl_3)
dev_1_bowl_2 = Line(cluster.dev_1_bowl_4)
dev_1_centr_field_w_1 = Slider(0, range=-10..10)
dev_1_centr_field_w_0 = Slider(0, range=-10..10)
dev_2_centr_field_w_0 = Slider(0, range=-10..10)
dev_2_centr_field_w_1 = Slider(0, range=-10..10)
dev_1_centr_field = Slider(-0.1, range=-10..20)
dev_2_centr_field = Slider(0, range=-10..20)
cluster_2 = Cluster(line=dev_1_bowl, num=dev_1_centr_field, num_2=dev_1_centr_field_w_1, num_3=dev_1_centr_field_w_0)  # -> lines, attributes
cluster_3 = Cluster(line=dev_1_bowl_2, num=dev_1_centr_field, num_2=dev_1_centr_field_w_1, num_3=dev_1_centr_field_w_0)  # -> lines, attributes
cluster_4 = Cluster(line=cluster.dev_2_bowl_5, num=dev_2_centr_field, num_2=dev_2_centr_field_w_1, num_3=dev_2_centr_field_w_0)  # -> lines, attributes
cluster_5 = Cluster(line=cluster.dev_2_bowl_6, num=dev_2_centr_field, num_2=dev_2_centr_field_w_1, num_3=dev_2_centr_field_w_0)  # -> lines, attributes

# ---- group: Deviation between opposite trails
devinitial_trail_ring1 = Line(cluster.line_25)
devinitial_trail_ring1_2 = Line(cluster.line_24)
devinitial_trail_ring2 = Line(cluster.line_22)
devinitial_trail_ring2_2 = Line(cluster.line_20)
devinitial_trail_centrline = Line(cluster.line_23)
attribute_5 = Slider(-6, range=-100..10)
attribute_6 = Slider(0, range=-20..40)
attribute_7 = Slider(-6, range=-100..101)
python_5 = GhPythonScript(Line=flatten([devinitial_trail_ring1, devinitial_trail_ring1_2]), Attribute=attribute_5)  # -> out, lines, attributes; inputs Line: list of Line; same code as python
python_6 = GhPythonScript(Line=flatten([devinitial_trail_ring2, devinitial_trail_ring2_2]), Attribute=attribute_6)  # -> out, lines, attributes; inputs Line: list of Line; same code as python
python_7 = GhPythonScript(Line=flatten(devinitial_trail_centrline), Attribute=attribute_7)  # -> out, lines, attributes; inputs Line: list of Line; same code as python

# ---- group: Deviation Between the trails
dev_2_cent = Line(cluster.dev_2_centr_3)
dev_2_cent_2 = Line(cluster.dev_2_cent_3)
dev_1_cent = Line(cluster.dev_1_centr_5)
dev_1_cent_2 = Line(cluster.dev_1_centr_6)
dev_1_2 = Line(cluster.dev_1_2_5)
dev_1_2_2 = Line(cluster.dev_1_2_6)
dev_2_centr_field_w_0_2 = Slider(0, range=-10..10)
dev_2_centr_field_w_1_2 = Slider(0, range=-10..10)
dev_2_centr_field_w_1_3 = Slider(0, range=-10..10)
dev_2_centr_field_w_0_3 = Slider(0, range=-10..10)
dev_2_centr_field_2 = Slider(0, range=-10..20)
dev_1_centr_field_2 = Slider(1, range=-10..20)
dev_1_2_field = Slider(0.767, range=-10..20)
dev_1_2_w_1 = Slider(0, range=-100..10)
dev_1_2_w_0 = Slider(0, range=-10..10)
cluster_6 = Cluster(line=dev_1_2_2, num=dev_1_2_field, num_2=dev_1_2_w_1, num_3=dev_1_2_w_0)  # -> lines, attributes
cluster_7 = Cluster(line=dev_1_2, num=dev_1_2_field, num_2=dev_1_2_w_1, num_3=dev_1_2_w_0)  # -> lines, attributes
cluster_8 = Cluster(line=dev_2_cent, num=dev_2_centr_field_2, num_2=dev_2_centr_field_w_1_2, num_3=dev_2_centr_field_w_0_2)  # -> lines, attributes
cluster_9 = Cluster(line=dev_2_cent_2, num=dev_2_centr_field_2, num_2=dev_2_centr_field_w_1_2, num_3=dev_2_centr_field_w_0_2)  # -> lines, attributes
cluster_10 = Cluster(line=dev_1_cent, num=dev_1_centr_field_2, num_2=dev_2_centr_field_w_1_3, num_3=dev_2_centr_field_w_0_3)  # -> lines, attributes
cluster_11 = Cluster(line=dev_1_cent_2, num=dev_1_centr_field_2, num_2=dev_2_centr_field_w_1_3, num_3=dev_2_centr_field_w_0_3)  # -> lines, attributes

# ---- group: Deviation between trails
dev_ring1_ring1 = Line(cluster.dev_ring1_ring1_2)
dev_ring2_ring2 = Line(cluster.dev_ring2_ring2_2)
dev_ring1_ring1_field = Slider(0.1, range=-10..10)
dev_ring1_ring1_w_1 = Slider(0, range=-50..51)
dev_ring1_ring1_w_0 = Slider(0, range=-10..10)
dev_ring2_ring2_field = Slider(0, range=-10..10)
dev_ring2_ring2_w_1 = Slider(0, range=-10..10)
dev_ring2_ring2_w_1_2 = Slider(0, range=-10..10)
cluster_12 = Cluster(line=dev_ring1_ring1, num=dev_ring1_ring1_field, num_2=dev_ring1_ring1_w_1, num_3=dev_ring1_ring1_w_0)  # -> lines, attributes
cluster_13 = Cluster(line=dev_ring2_ring2, num=dev_ring2_ring2_field, num_2=dev_ring2_ring2_w_1, num_3=dev_ring2_ring2_w_1_2)  # -> lines, attributes

# ----
supportpt = Point(flatten(cluster.supportpt_2))
cluster_14 = Cluster_4(
    line=line,
    txt=dup,
    trail_ring1=python.lines,
    att_trail_ring1=python.attributes,
    trail_ring2=python_2.lines,
    att_trail_ring2=python_2.attributes,
    trail_centrline=python_3.lines,
    num_5=python_3.attributes,
    perimeter_of_bowl=python_4.lines,
    num=python_4.attributes,
    devinitial_trail_ring1=python_5.lines,
    num_3=python_5.attributes,
    devinitial_trail_ring2=python_6.lines,
    num_4=python_6.attributes,
    devinitial_trail_centrline=python_7.lines,
    num_2=python_7.attributes,
    dev_1_2_2=cluster_6.lines,
    B=cluster.int_5,
    att_dev_1_2_2=cluster_6.attributes,
    dev_1_2=cluster_7.lines,
    att_dev_1_2=cluster_7.attributes,
    dev_2_centr_2=cluster_8.lines,
    att_dev_2_centr=cluster_8.attributes,
    dev_2_centr=cluster_9.lines,
    att_dev_2_centr_2=cluster_9.attributes,
    dev_1_centr=cluster_10.lines,
    att_dev_1_centr=cluster_10.attributes,
    dev_1_centr_2=cluster_11.lines,
    att_dev_1_centr_2=cluster_11.attributes,
    dev_ring1_ring1=cluster_12.lines,
    data_2=cluster_12.attributes,
    dev_ring2_ring2=cluster_13.lines,
    data=cluster_13.attributes,
    dev_1_bowl_2=cluster_2.lines,
    dev_1_bowl=cluster_2.attributes,
    dev_1_bowl_3=cluster_3.lines,
    dev_1_bowl_4=cluster_3.attributes,
    dev_2_bowl_2=cluster_4.lines,
    dev_2_bowl=cluster_4.attributes,
    dev_2_bowl_3=cluster_5.lines,
    dev_2_bowl_4=cluster_5.attributes,
    support=supportpt)  # -> external_force_2, txt_6, trails_2, txt_5, deviation_2, txt_8, support_3

# ---- group: Topology Generation
support = Point(flatten(cluster_14.support_3))
external_force = Curve(flatten(cluster_14.external_force_2))
trails = Curve(flatten(cluster_14.trails_2))
deviation = Curve(flatten(cluster_14.deviation_2))
txt = Text(flatten(cluster_14.txt_6))
txt_2 = Text(flatten(cluster_14.txt_5))
txt_3 = Text(flatten(cluster_14.txt_8))
topologygeneration_py = PythonScript(
    externalForces=external_force,
    externalForcesID=txt,
    trailMembers=trails,
    trailMembersID=txt_2,
    deviationMembers=deviation,
    deviationMembersID=txt_3,
    supports=support)  # -> T; inputs externalForces: list of Line, externalForcesID: list, trailMembers: list of Curve, trailMembersID: list, deviationMembers: list of Curve, deviationMembersID: list, supports: list of Point3d
# ---------- topologygeneration_py: Python ----------
"""
Defines a new topological diagram from inputs
    Inputs:
        externalForces: (curves) The curves that define the external forces in the topological diagram
        externalForcesID: (guid or string) The attributes associated to the external forces in the topological diagram
        trailMembers: (curves) The curves that define the trail members in the topological diagram
        trailMembersID: (guid or string) The lenghts of the trail members in the topological diagram (tension-positive, compression-negative)
        deviationMembers: (curves) The curves that define the deviation members in the topological diagram
        deviationMembersID: (guid or string) The force magnitudes of the deviation members (tension-positive, compression-negative) in the topological diagram
        supports: (points) The support points in the topological diagram
    Outputs:
        T: (topological diagram) The constructed topological diagram (empty topology on error)
    Remarks:
        This generates a new instance of the topological diagram
"""

__author__    = ['Patrick Ole Ohlbrock','Pierluigi D''Acunto' ]
__copyright__ = 'Copyright 2018 - Chair of Structural Design, ETH Zurich'
__license__   = 'MIT License'
__email__     = 'ohlbrock@arch.ethz.ch'
__version__   = "1.0.0"

"""
If you use the library of CEM in a project, please refer to the CEM GitHub repository:
@misc{cem-dev,
    title  = {{CEM}: Combinatorial Equilibrium Modeling},
    author = {Patrick Ole Ohlbrock and Pierluigi D'Acunto},
    note   = {https://github.com/OleOhlbrock/CEM},
    year   = {2018},
}
"""




import System.Drawing.Color
import System.Guid
import Rhino
from ast import literal_eval
int0_T = 0.1

from _ast import *
from _ast import __version__

class topology(object):
    def __repr__(self):
        return self.ToString()
        
    def __str__(self):
        return self.ToString()
        
    def ToString(self):
        if trailMembers and trailMembersID:
            if len(trailMembers) == len(trailMembersID):
                str0_Description = ""
                if hasattr(self, "str1_StructuralBehaviourOut") or hasattr(self, "db1_StructuralBehaviourOut")  and pt1_NodeOut and int2_Trail:
                    str0_Description += "Topological Diagram\n\nvertices: " + str(len(pt1_NodeOut)) + "\ntrail members: " + str(len(int2_Trail)) 
                    if int2_Deviation1:
                        str0_Description += "\ndirect deviation members: " + str(len(int2_Deviation1))
                        if str2_Deviation2:
                            str0_Description += "\nindirect deviation members: " + str(len(str2_Deviation2))
                    return str0_Description
                else:
                    return "Empty topology"
            else:
                return "Empty topology"
        else:
            return "Empty topology"


def ListListToList(xx2_Data):
    xx1_DataOut = []
    for xx1_Data in xx2_Data:
        xx1_DataOut.extend(xx1_Data)
    return xx1_DataOut


T = topology()

if trailMembers and trailMembersID:
    if len(trailMembers) == len(trailMembersID) and len(deviationMembers) == len(deviationMembersID) and len(externalForces) == len(externalForcesID):

        # Create List of Nodes and trailMembers' Connectivity
        pt1_Node = []
        int2_Trail = []
        int2_Deviation = []
        int2_ExtForce = []
        
        pt1_Node.append(trailMembers[0].PointAtStart)
        
        # Nodes and Egdes from trailMembers
        for crv0_Trail in trailMembers:
            int1_Trail = []
            pt0_Start = crv0_Trail.PointAtStart
            bl0_Check = False
            for i in xrange(len(pt1_Node)):
                if abs(pt0_Start.X - pt1_Node[i].X) < int0_T and abs(pt0_Start.Y - pt1_Node[i].Y) < int0_T and abs(pt0_Start.Z - pt1_Node[i].Z) < int0_T:
                    int1_Trail.append(i)
                    bl0_Check = True
                    break
            if bl0_Check == False:
                pt1_Node.append(pt0_Start)
                int1_Trail.append(len(pt1_Node)-1)
            pt0_End = crv0_Trail.PointAtEnd
            bl0_Check = False
            for i in xrange(len(pt1_Node)):
                if abs(pt0_End.X - pt1_Node[i].X) < int0_T and abs(pt0_End.Y - pt1_Node[i].Y) < int0_T and abs(pt0_End.Z - pt1_Node[i].Z) < int0_T:
                    int1_Trail.append(i)
                    bl0_Check = True
                    break
            if bl0_Check == False:
                pt1_Node.append(pt0_End)
                int1_Trail.append(len(pt1_Node)-1)
            int2_Trail.append(int1_Trail)
        
        # Deviation
        crv1_DeviationClean = []
        id1_DeviationClean = []
        for k in xrange(len(deviationMembers)):
            pt0_StartDeviation = deviationMembers[k].PointAtStart
            pt0_EndDeviation = deviationMembers[k].PointAtEnd
            for i in xrange(len(pt1_Node)):
                if abs(pt0_StartDeviation.X - pt1_Node[i].X) < int0_T and abs(pt0_StartDeviation.Y - pt1_Node[i].Y) < int0_T and abs(pt0_StartDeviation.Z - pt1_Node[i].Z) < int0_T:
                    for j in xrange(len(pt1_Node)):
                        if abs(pt0_EndDeviation.X - pt1_Node[j].X) < int0_T and abs(pt0_EndDeviation.Y - pt1_Node[j].Y) < int0_T and abs(pt0_EndDeviation.Z - pt1_Node[j].Z) < int0_T:
                            crv1_DeviationClean.append(deviationMembers[k])
                            id1_DeviationClean.append(deviationMembersID[k])
                            int1_Deviation = []
                            int1_Deviation.append(i)
                            int1_Deviation.append(j)
                            int2_Deviation.append(int1_Deviation)
                            break
                    break
        deviationMembers = crv1_DeviationClean
        deviationMembersID = id1_DeviationClean
        
        # External Force
        ln1_ExtForceClean = []
        External_Forces_IDClean = []
        for k in xrange(len(externalForces)):
            pt0_StartExtForce = externalForces[k].From
            pt0_EndExtForce = externalForces[k].To
            for i in xrange(len(pt1_Node)):
                int1_ExtForce = []
                if abs(pt0_StartExtForce.X - pt1_Node[i].X) < int0_T and abs(pt0_StartExtForce.Y - pt1_Node[i].Y) < int0_T and abs(pt0_StartExtForce.Z - pt1_Node[i].Z) < int0_T:
                    ln1_ExtForceClean.append(externalForces[k])
                    External_Forces_IDClean.append(externalForcesID[k])
                    int1_ExtForce.append(i)
                    int2_ExtForce.append(int1_ExtForce)
                    break
            for j in xrange(len(pt1_Node)):
                if abs(pt0_EndExtForce.X - pt1_Node[j].X) < int0_T and abs(pt0_EndExtForce.Y - pt1_Node[j].Y) < int0_T and abs(pt0_EndExtForce.Z - pt1_Node[j].Z) < int0_T:
                    ln1_ExtForceClean.append(externalForces[k])
                    External_Forces_IDClean.append(externalForcesID[k])
                    int1_ExtForce.append(j)
                    int2_ExtForce.append(int1_ExtForce)
                    break
        
        externalForces = ln1_ExtForceClean
        externalForcesID = External_Forces_IDClean
        
        
        # Extract Attributes External Forces
        str2_ExtForceAtt = []
        
        for id0_ExtForce in externalForcesID:
            str1_ExtForceAtt = []
            if type(id0_ExtForce) is str:
                str1_ExtForceAtt = literal_eval(id0_ExtForce.replace("^", ""))
            elif type(id0_ExtForce) is System.Guid:
                obj0_ExtForceAtt = Rhino.DocObjects.ObjRef(id0_ExtForce)
                str0_ExtForceAtt = obj0_ExtForceAtt.Object().Attributes.Name
                if str0_ExtForceAtt: 
                    str1_ExtForceAttEv = (('0','0','-1'))
                    try:
                        str1_ExtForceAttEv = literal_eval(str0_ExtForceAtt.replace("^", ""))
                    except:
                        str2_ExtForceAtt.append(('0','0','-1'))
                    if isinstance(str1_ExtForceAttEv, tuple) and len(str1_ExtForceAttEv) == 3:
                        str1_ExtForceAtt = str1_ExtForceAttEv
                    else:
                        str2_ExtForceAtt.append(('0','0','-1'))
                else:
                    str2_ExtForceAtt.append(('0','0','-1'))
            else:
                str2_ExtForceAtt.append(('0','0','-1'))
            if str1_ExtForceAtt:
                str1_ExtForceAttC = []
                for i in xrange(len(str1_ExtForceAtt)):
                    str1_ExtForceAttC.append(str(str1_ExtForceAtt[i]))
                str2_ExtForceAtt.append(tuple(str1_ExtForceAttC))
        
        
        # Extract Attributes trailMembers
        str1_TrailAtt = []
        
        for id0_Trail in trailMembersID:
            if type(id0_Trail) is str:
                str0_TrailAtt = id0_Trail
            else:
                obj0_TrailAtt = Rhino.DocObjects.ObjRef(id0_Trail)
                str0_TrailAtt = obj0_TrailAtt.Object().Attributes.Name
            if str0_TrailAtt:
                str1_TrailAtt.append(str0_TrailAtt)
            else:
                str1_TrailAtt.append("1")
        
        # Extract Attributes Deviation
        str1_DeviationAtt = []
        
        for id0_Deviation in deviationMembersID:
            if type(id0_Deviation) is str:
                str0_DeviationAtt = id0_Deviation
            else:
                obj0_DeviationAtt = Rhino.DocObjects.ObjRef(id0_Deviation)
                str0_DeviationAtt = obj0_DeviationAtt.Object().Attributes.Name
            if str0_DeviationAtt:
                str1_DeviationAtt.append(str0_DeviationAtt)
            else:
                str1_DeviationAtt.append("1")
        
        # Create Dictionary of trailMembers' Ends
        dc2_TrailEnds = {}
        for i in xrange(len(int2_Trail)):
            dc2_TrailEnds[str(i)] = [str(x) for x in int2_Trail[i]]
        
        # Create Dictionary of trailMembers' Attributes
        dc1_TrailAtt = {}
        for i in xrange(len(str1_TrailAtt)):
            dc1_TrailAtt[str(i)] = str1_TrailAtt[i]
        
        
        # Create Dictionary of External Forces' End
        dc1_ExtForceEnds = {}
        for i in xrange(len(int2_ExtForce)):
            dc1_ExtForceEnds[str(i)] = str(int2_ExtForce[i][0])
        
        
        # Create Dictionary of External Forces' Attributes
        dc2_ExtForceAtt = {}
        for i in xrange(len(str2_ExtForceAtt)):
            dc2_ExtForceAtt[str(i)] = [x for x in str2_ExtForceAtt[i]]

        
        # Create Lists of Node-Node Connectivity from trailMembers
        int2_Node = []
        for pt0_Node in pt1_Node:
            int1_Node = []
            int2_Node.append(int1_Node)
        for int1_Trail in int2_Trail:
            int2_Node[int1_Trail[0]].append(int1_Trail[1])
            int2_Node[int1_Trail[1]].append(int1_Trail[0])
        
        
        # Create Lists of Deviations' Ends and Attributes
        str2_Deviation = []
        for i in xrange(len(str1_DeviationAtt)):
            str2_Deviation.append( [str(item) for item in int2_Deviation[i] ] )
            str2_Deviation[i].extend([str1_DeviationAtt[i]])
        
        # Convert Trail Input into Polylines
        ln1_Trail = []
        for crv0_Trail in trailMembers:
            if crv0_Trail is Rhino.Geometry.Line:
                ln1_Trail.append(crv0_Trail)
            else:
                ln1_Trail.append(Rhino.Geometry.Line(crv0_Trail.PointAtStart, crv0_Trail.PointAtEnd))
        
        trailMembers = []
        for ln0_Trail in ln1_Trail:
            trailMembers.append(ln0_Trail.ToNurbsCurve())
        
        plc1_Trail = Rhino.Geometry.Curve.JoinCurves(trailMembers)
        
        pln1_Trail = []
        for plc0_Trail in plc1_Trail:
            pln1_Trail.append(plc0_Trail.TryGetPolyline()[1])
        
        
        # Check supports
        pt1_SupportClean = []
        for j in xrange(len(pln1_Trail)):
            if supports:
                pt1_SupportClean.append(pln1_Trail[j][len(pln1_Trail[j])-1])
                for i in xrange(len(supports)):
                    if abs(pln1_Trail[j][0].X - supports[i].X) < int0_T and abs(pln1_Trail[j][0].Y - supports[i].Y) < int0_T and abs(pln1_Trail[j][0].Z - supports[i].Z) < int0_T:
                        pt1_SupportClean[j] = pln1_Trail[j][0]
                        pln1_Trail[j].Reverse()
            else:
                pt1_SupportClean.append(pln1_Trail[j][len(pln1_Trail[j])-1])
        supports = pt1_SupportClean
        
        
        # Find Node Indexes of supports
        int1_Support = []
        for pt0_Support in supports:
            for i in xrange(len(pt1_Node)):
                if abs(pt0_Support.X - pt1_Node[i].X) < int0_T and abs(pt0_Support.Y - pt1_Node[i].Y) < int0_T and abs(pt0_Support.Z - pt1_Node[i].Z) < int0_T:
                    int1_Support.append(i)
                    break
        
        # Create Graph (Dictionary of Node-Node Connectivity from trailMembers)
        dc2_Node = {}
        for i in xrange(len(int2_Node)):
            dc2_Node[str(i)] = [str(x) for x in int2_Node[i]]
        
        int2_TrailPoly = []
        for pln0_Trail in pln1_Trail:
            int1_TrailPoly = []
            for i in xrange(len(pln0_Trail)):
                int1_TrailPoly.append(pt1_Node.IndexOf(pln0_Trail[i]))
            int2_TrailPoly.append(list(reversed(int1_TrailPoly)))
        
        dc2_ShortPath = {}
        
        for i in xrange(len(pt1_Node)):
            for int1_TrailPoly in int2_TrailPoly:
                if i in int1_TrailPoly:
                    str1_ShortPath = ["S"]
                    str1_ShortPath.extend(map(str, int1_TrailPoly[:int1_TrailPoly.index(i)+1]))
                    dc2_ShortPath[str(i)] = str1_ShortPath
                    break
        
        dc1_ShortPathDist = {}
        dc2_ShortPathDistGrade = {}
        
        for i in xrange(len(pt1_Node)):
            for pln0_Trail in pln1_Trail:
                if pln0_Trail.Contains(pt1_Node[i]):
                    dc1_ShortPathDist[str(i)] = len(pln0_Trail) - pln0_Trail.IndexOf(pt1_Node[i])
                    break
        
        
        # Define Sequences
        for key in dc1_ShortPathDist:
            if dc1_ShortPathDist[key] not in dc2_ShortPathDistGrade:
                dc2_ShortPathDistGrade[dc1_ShortPathDist[key]] = [key]
            else:
                dc2_ShortPathDistGrade[dc1_ShortPathDist[key]].extend([key])
        
        
        # Separate deviation_1 (direct) and deviation_2 (indirect-bracing)
        
        dc2_Deviation1Ends = {}
        dc2_Deviation2Ends = {}
        
        dc1_Deviation1Att = {}
        dc1_Deviation2Att = {}
        
        int2_Deviation1 = []
        str2_Deviation2 = []
        
        crv1_Deviation1 = []
        crv1_Deviation2 = []
        
        j = 0
        k = 0
        
        for i in xrange(len(str2_Deviation)):
            if dc1_ShortPathDist[ str(str2_Deviation[i][0]) ] == dc1_ShortPathDist[ str(str2_Deviation[i][1]) ]:
                dc2_Deviation1Ends[str(j)] = [str(str2_Deviation[i][0]),str(str2_Deviation[i][1])]
                dc1_Deviation1Att[str(j)] = str(str2_Deviation[i][2])
                int2_Deviation1.append([int(str2_Deviation[i][0]),int(str2_Deviation[i][1])])
                crv1_Deviation1.append(deviationMembers[i])
                j += 1
            else:
                dc2_Deviation2Ends[str(k)] = [str(str2_Deviation[i][0]),str(str2_Deviation[i][1])]
                dc1_Deviation2Att[str(k)] = str(str2_Deviation[i][2])
                str2_Deviation2.append(str2_Deviation[i])
                crv1_Deviation2.append(deviationMembers[i])
                k += 1
        
        
        
        # Create Dictionary of Trail and Deviation 1 for Structural Matrix
        dc2_EdgeEnds = {}
        for key in dc2_TrailEnds:
            dc2_EdgeEnds[str(int(key))] = dc2_TrailEnds[key]
        for key in dc2_Deviation1Ends:
            dc2_EdgeEnds[str(int(key)+len(dc2_TrailEnds))] = dc2_Deviation1Ends[key]
        
        dc1_EdgeAtt = {}
        for key in dc1_TrailAtt:
            dc1_EdgeAtt[str(int(key))] = dc1_TrailAtt[key]
        for key in dc1_Deviation1Att:
            dc1_EdgeAtt[str(int(key)+len(dc1_TrailAtt))] = dc1_Deviation1Att[key]
        
        # Create Dictionary of Trail and Deviation 1 and 2 for Visualization
        dc1_Edge = {}
        for key in dc1_TrailAtt:
            dc1_Edge[str(int(key))] = dc1_TrailAtt[key]
        for key in dc1_Deviation1Att:
            dc1_Edge[str(int(key)+len(dc1_TrailAtt))] = dc1_Deviation1Att[key]
        for key in dc1_Deviation2Att:
            dc1_Edge[str(int(key)+len(dc1_TrailAtt)+len(dc1_Deviation1Att))] = dc1_Deviation2Att[key]
        
        
        ## Visualization
        
        # Nodes
        pt1_NodeOut = pt1_Node
        pt1_TargetOut = pt1_NodeOut
        str1_NodeOut = [str(i) + " (" + str(dc1_ShortPathDist[str(i)]) + ")" for i in xrange(len(pt1_Node))]
        str1_TargetOut = [str(i) for i in xrange(len(pt1_Node))]
        
        # Edges
        crv1_Edge = []
        for crv0_Trail in trailMembers: crv1_Edge.append(crv0_Trail)
        for crv0_Deviation1 in crv1_Deviation1: crv1_Edge.append(crv0_Deviation1)
        for crv0_Deviation2 in crv1_Deviation2: crv1_Edge.append(crv0_Deviation2)
        
        crv1_EdgeOut = crv1_Edge
        pt1_EdgeOut = [crv0_Edge.PointAtNormalizedLength(0.6) for crv0_Edge in crv1_EdgeOut]
        str1_EdgeOut = [str(i) + " (" + dc1_Edge[str(i)] + ")" for i in xrange(len(crv1_EdgeOut))]
        
        
        # Update Lists of Node-Node Connectivity from Deviation 1
        for int1_DevTemp in int2_Deviation1:
            int2_Node[int1_DevTemp[0]].append(int1_DevTemp[1])
            int2_Node[int1_DevTemp[1]].append(int1_DevTemp[0])
        
        
        # Create Graph (Dictionary of Node-Node Connectivity from trailMembers)
        for i in xrange(len(int2_Node)):
            dc2_Node[str(i)] = [str(x) for x in int2_Node[i]]
        
        
        ## Create Dictionaries for Structural Matrix
        dc1_NodeTrailOut = {}
        dc1_NodeTrailIn = {}
        dc2_NodeDeviation = {}
        dc1_NodeExtForce = {}
        dc1_NodeExtForceAtt = {}
        int0_NodeTrailIn = {}
        
        # Trail In and Out
        for key in dc2_ShortPath:
            dc1_NodeTrailOut[key] = dc2_ShortPath[key][len(dc2_ShortPath[key])-2]
        for key in dc1_NodeTrailOut:
            if dc1_NodeTrailOut[key] != "S":
                dc1_NodeTrailIn[dc1_NodeTrailOut[key]] = key
        
        for key in dc1_NodeTrailOut:
            if key not in dc1_NodeTrailIn:
                dc1_NodeTrailIn[key] = "L"#+str(key)
        
        # Deviation
        for key in dc2_Node:
            str1_v = []
            for v in dc2_Node[key]:
                if v != dc1_NodeTrailOut[key] and v != dc1_NodeTrailIn[key]:
                    str1_v.append(v)
            dc2_NodeDeviation[key] = str1_v
        
        # External Forces
        for key in dc1_ExtForceEnds:
            if dc1_ExtForceEnds[key] not in dc1_NodeExtForce:
                dc1_NodeExtForce[dc1_ExtForceEnds[key]] = [key]
            else:
                dc1_NodeExtForce[dc1_ExtForceEnds[key]].extend(key)
        
        for key in dc1_NodeExtForce:
            for v in dc1_NodeExtForce[key]:
                if dc1_ExtForceEnds[v] not in dc1_NodeExtForceAtt:
                    dc1_NodeExtForceAtt[key] = [item for item in dc2_ExtForceAtt[v]]
                else:
                    xx1_NodeExtForceAtt = dc1_NodeExtForceAtt[dc1_ExtForceEnds[v]]
                    for i in xrange(len(xx1_NodeExtForceAtt)):
                        try:
                            xx1_NodeExtForceAtt[i] = float(xx1_NodeExtForceAtt[i])
                        except:
                            xx1_NodeExtForceAtt[i] = -1.0
                            
                            
                    try:
                        dc2_ExtForceAtt[v][0] = float(dc2_ExtForceAtt[v][0])
                    except:
                        dc2_ExtForceAtt[v][0] = -1.0
                    try:
                        dc2_ExtForceAtt[v][1] = float(dc2_ExtForceAtt[v][1])
                    except:
                        dc2_ExtForceAtt[v][1] = -1.0
                    try:
                        dc2_ExtForceAtt[v][2] = float(dc2_ExtForceAtt[v][2])
                    except:
                        dc2_ExtForceAtt[v][2] = -1.0
                    dc1_NodeExtForceAtt[key][0] += float(dc2_ExtForceAtt[v][0])
                    dc1_NodeExtForceAtt[key][1] += float(dc2_ExtForceAtt[v][1])
                    dc1_NodeExtForceAtt[key][2] += float(dc2_ExtForceAtt[v][2])
        
        
        ## Create Structural Matrix According to Weight
        
        # Initialize Matrix with Indices
        str2_StructuralMatrix = []
        str1_NodeOrderMatrix = []
        str2_NodeOrderMatrix = []
        
        str1_NodeOrder = dc2_ShortPathDistGrade[1]
        
        for i in sorted(xrange(1,len(dc2_ShortPathDistGrade)+1)):
            str1_NodeOrderUp = []
            str2_NodeOrderMatrix.append(str1_NodeOrder)
            for str0_NodeOrder in str1_NodeOrder:
                str1_NodeOrderMatrix.append(str0_NodeOrder)
                if str0_NodeOrder[0] != "L":
                    str2_StructuralMatrix.append(["0"]*(3+len(str1_NodeOrder)+1))
                    str1_NodeOrderUp.append(dc1_NodeTrailIn[str0_NodeOrder])
                else:
                    str2_StructuralMatrix.append(["0"]*(3+len(str1_NodeOrder)+1))
                    str1_NodeOrderUp.append("L")
            str1_NodeOrder = str1_NodeOrderUp
        
        int0_NodeOrderMatrix = len(str2_NodeOrderMatrix[0])
        
        
        # Add Attribute External Forces
        for key in dc1_NodeExtForce:
            int0_NodeIndex = str1_NodeOrderMatrix.index(key)
            str2_StructuralMatrix[int0_NodeIndex][0:3] = [str(item) for item in dc1_NodeExtForceAtt[key]]
        
        # Add Attribute Trail Out
        for key in dc2_EdgeEnds:
            if dc2_EdgeEnds[key][0] in dc1_NodeTrailOut and dc2_EdgeEnds[key][1] == dc1_NodeTrailOut[dc2_EdgeEnds[key][0]]:
                int0_NodeIndex = str1_NodeOrderMatrix.index(dc2_EdgeEnds[key][0])
                str2_StructuralMatrix[int0_NodeIndex][len(str2_StructuralMatrix[int0_NodeIndex])-1] = dc1_EdgeAtt[key]
            elif dc2_EdgeEnds[key][1] in dc1_NodeTrailOut and dc2_EdgeEnds[key][0] == dc1_NodeTrailOut[dc2_EdgeEnds[key][1]]:
                int0_NodeIndex = str1_NodeOrderMatrix.index(dc2_EdgeEnds[key][1])
                str2_StructuralMatrix[int0_NodeIndex][len(str2_StructuralMatrix[int0_NodeIndex])-1] = dc1_EdgeAtt[key]
        
        # Add Attribute Deviation
        for key in dc2_EdgeEnds:
            if dc2_EdgeEnds[key][0] in dc2_NodeDeviation and dc2_EdgeEnds[key][1] in dc2_NodeDeviation[dc2_EdgeEnds[key][0]]:
                int0_NodeIndex = str1_NodeOrderMatrix.index(dc2_EdgeEnds[key][0])
                int0_NodeIndexTo = str1_NodeOrderMatrix.index(dc2_EdgeEnds[key][1])
                int0_NodeIndexRaw = (int0_NodeIndexTo) % int0_NodeOrderMatrix
                str2_StructuralMatrix[int0_NodeIndex][3 + int0_NodeIndexRaw] = dc1_EdgeAtt[key]
            if dc2_EdgeEnds[key][1] in dc2_NodeDeviation and dc2_EdgeEnds[key][0] in dc2_NodeDeviation[dc2_EdgeEnds[key][1]]:
                int0_NodeIndex = str1_NodeOrderMatrix.index(dc2_EdgeEnds[key][1])
                int0_NodeIndexTo = str1_NodeOrderMatrix.index(dc2_EdgeEnds[key][0])
                int0_NodeIndexRaw = (int0_NodeIndexTo) % int0_NodeOrderMatrix
                str2_StructuralMatrix[int0_NodeIndex][3 + int0_NodeIndexRaw] = dc1_EdgeAtt[key]
        
        # Order Matrix
        str2_StructuralMatrixOrder = []
        int1_StructuralMatrixOrder = []
        str2_NodeOrderMatrixReversed = []
        
        for i in reversed(xrange(1,len(str2_NodeOrderMatrix)+1)):
            for j in xrange(int0_NodeOrderMatrix):
                int0_Index = int0_NodeOrderMatrix*(i-1)+j
                if i != len(str2_NodeOrderMatrix):
                    int1_StructuralMatrixOrder.append(str2_NodeOrderMatrix[i-1][j])
                str2_StructuralMatrixOrder.append(str2_StructuralMatrix[int0_NodeOrderMatrix*(i-1)+j])
        
        for i in reversed(xrange(1,len(str2_NodeOrderMatrix)+1)):
            str1_NodeOrderMatrixReversed = []
            for j in xrange(int0_NodeOrderMatrix):
                str1_NodeOrderMatrixReversed.append(str2_NodeOrderMatrix[i-1][j])
            str2_NodeOrderMatrixReversed.append(str1_NodeOrderMatrixReversed)
        
        # Substitute Node Index with Matrix Index in Deviation2
        str1_Deviation2 = ListListToList(str2_Deviation2)
        str1_NodeOrder = ListListToList(str2_NodeOrderMatrixReversed)
        
        for i in xrange(len(str1_Deviation2)):
            if (i+1) % 3 != 0:
                str1_Deviation2[i] = str1_NodeOrder.index(str(str1_Deviation2[i]))
        
        
        ## Output
        str1_DeviationIndirectOut = str1_Deviation2
        str1_StructuralBehaviourOut = ListListToList(str2_StructuralMatrixOrder)
        
        
        #### AUTOMATIC GEOMETRIC INPUT FOR FORM DIAGRAM
        
        # str1_NodeOrderOut from Graph with "L" where leaf (as List)
        # str1_NodeOrderC = Clean Node Order without L but duplicated node numbers where needed
        # pt1_NodeOut = geometric locations from vertices in graph
        
        # Amount of layers
        N_layers = len(str1_NodeOrder)/len(supports)
        
        # Clean up the sequence of nodes in the network, create duplicates where the trail is shorter
        for j in xrange(N_layers):
            for i in xrange(len(str1_NodeOrder)):
                if str1_NodeOrder[i]== "L":
                    str1_NodeOrder[i] = str1_NodeOrder[i+len(supports)]
        str1_TrailTipOrder = str1_NodeOrder[:len(supports)]
        
        # Get the position of the origin points from the topological diagram
        
        pt1_OriginNodeOut = []
        for i in xrange(len((supports))):
            pt0_OriginNodeOut = pt1_NodeOut[int(str1_TrailTipOrder[i])] 
            pt1_OriginNodeOut.append(pt0_OriginNodeOut)
        
        # projection of points in World-x-y plane
        pt2_NodePlanes = []
        
        for i in xrange(len(pt1_NodeOut)):
            pt1_NodePlanes = Rhino.Geometry.Point3d(pt1_NodeOut[i][0],pt1_NodeOut[i][1],0.0)
            pt2_NodePlanes.append(pt1_NodePlanes)
        
        # Get the constraint planes from the vertices from the topological diagram
        pl1_ConstraintPlaneOut = []
        pl0_ConstraintPlaneOut = []
        vc0_NormalVectorPlane = []
        
        for i in xrange(len(str1_NodeOrder)-len(supports)):
             vc0_NormalVectorPlane =  Rhino.Geometry.Vector3d(pt2_NodePlanes[int(str1_NodeOrder[i])]-pt2_NodePlanes[int(str1_NodeOrder[i+len(supports)])])
             pl0_ConstraintPlaneOut = Rhino.Geometry.Plane(pt2_NodePlanes[int(str1_NodeOrder[i+len(supports)])],vc0_NormalVectorPlane)
             pl1_ConstraintPlaneOut.append(pl0_ConstraintPlaneOut)
        
        
        str1_NodeOrderOut = str1_NodeOrder
        int1_ConstraintPlaneOut = str1_NodeOrder[len(supports):]
        
        
        
        T.str1_StructuralBehaviourOut = str1_StructuralBehaviourOut
        T.str1_DeviationIndirectOut = str1_DeviationIndirectOut
        T.pt1_NodeOut = pt1_NodeOut
        T.str1_NodeOut = str1_NodeOut
        T.crv1_EdgeOut = crv1_EdgeOut
        T.pt1_EdgeOut = pt1_EdgeOut
        T.str1_EdgeOut = str1_EdgeOut
        T.str1_NodeOrderOut = str1_NodeOrderOut
        T.pl1_ConstraintPlaneOut = pl1_ConstraintPlaneOut
        T.int1_ConstraintPlaneOut = int1_ConstraintPlaneOut
        T.pt1_OriginNodeOut = pt1_OriginNodeOut
# ---------- end topologygeneration_py ----------

# ---- group: Save Files
savefiles_py = PythonNoHint(execute=Toggle(False))  # -> out
# ---------- savefiles_py: Python ----------
import Grasshopper
import GhPython

if execute:
    
    gh_doc = ghenv.Component.OnPingDocument()
    location = ghenv.LocalScope.gh_doc.FilePath
    
    import os
    folder = os.path.dirname(location)
    
    GhPython.Component.ZuiPythonComponent
    
    for o in gh_doc.Objects:
        if not isinstance(o, GhPython.Component.ZuiPythonComponent): continue
        if o.CodeInputParam: continue
        filename = o.NickName
        if not filename: continue
        
        if not filename.endswith("py"): continue
        
        file_location = os.path.join(folder, filename)
        #
        with open(file_location, 'w+') as fh:
            fh.write(o.Code.Replace("\r\n", "\n"))
            
        print("Saved: {}".format(file_location))
# ---------- end savefiles_py ----------
panel_2 = Panel(savefiles_py)

# ----
T = PythonNoHint(T=topologygeneration_py)  # -> pt1_OriginNode
# ---------- T: Python ----------
if T:
    pt1_OriginNode = T.pt1_OriginNodeOut
# ---------- end T ----------
T_2 = PythonNoHint(T=topologygeneration_py)  # -> pl1_ConstraintPlane, int1_ConstraintPlane
# ---------- T_2: Python ----------
if T:
    pl1_ConstraintPlane = T.pl1_ConstraintPlaneOut
    int1_ConstraintPlane = T.int1_ConstraintPlaneOut
# ---------- end T_2 ----------
pt_groundlevel = Point(<point referenced from the Rhino model>)
panel_3 = Panel(topologygeneration_py)

# ---- group: Topology Parametric Variation
merge = Merge(
    Data1=flatten(Slider(-3.624, range=-10..10)),
    Data2=flatten(Slider(1.2, range=-10..10)),
    Data3=flatten(Slider(50, range=0..50)),
    Data4=flatten(Slider(0, range=-10..10)))
panel_4 = Panel("""a
b
c""")
topologyparametricvariation_py = PythonScript(T=topologygeneration_py, parameters=panel_4, values=merge)  # -> TM; inputs parameters: list, values: list
# ---------- topologyparametricvariation_py: Python ----------
"""
Update a topological diagram from parametric inputs
    Inputs:
        T: (topological diagram) The topological diagram used for the parametric variation
        parameters: (string) The parameters used for the parametric variation
        values: (double) The values associated to the parameters
    Outputs:
        TM: (updated topological diagram) The topological diagram updated with the parametric values (empty topology on error)
    Remarks:
        This generates a new instance of the topological diagram
"""

__author__    = ['Patrick Ole Ohlbrock','Pierluigi D''Acunto' ]
__copyright__ = 'Copyright 2018 - Chair of Structural Design, ETH Zurich'
__license__   = 'MIT License'
__email__     = 'ohlbrock@arch.ethz.ch'
__version__   = "1.0.0"

"""
If you use the library of CEM in a project, please refer to the CEM GitHub repository:
@misc{cem-dev,
    title  = {{CEM}: Combinatorial Equilibrium Modeling},
    author = {Patrick Ole Ohlbrock and Pierluigi D'Acunto},
    note   = {https://github.com/OleOhlbrock/CEM},
    year   = {2018},
}
"""



def StringToFloat(val):
    try:
        return float(val)
    except (ValueError, TypeError):
        return 1.0

import copy
TM = copy.deepcopy(T)


if TM and hasattr(TM, "str1_StructuralBehaviourOut"):
    str1_StructuralBehaviour = T.str1_StructuralBehaviourOut[:]
    str1_DeviationIndirect = T.str1_DeviationIndirectOut[:]
    db1_StructuralBehaviour = []
    db1_DeviationIndirect = []
        
    for i in xrange(len(str1_StructuralBehaviour)):
        if str1_StructuralBehaviour[i] in parameters:
            int0_index = parameters.index(str1_StructuralBehaviour[i])
            if len(values) > int0_index:
                db1_StructuralBehaviour.append(float(values[int0_index]))
            else: 
                db1_StructuralBehaviour.append(StringToFloat(str1_StructuralBehaviour[i]))
        else: 
            db1_StructuralBehaviour.append(StringToFloat(str1_StructuralBehaviour[i]))
    
    for i in xrange(len(str1_DeviationIndirect)):
        if str1_DeviationIndirect[i] in parameters:
            int0_index = parameters.index(str1_DeviationIndirect[i])
            if len(values) > int0_index:
                db1_DeviationIndirect.append(float(values[int0_index]))
            else: 
                db1_DeviationIndirect.append(StringToFloat(str1_DeviationIndirect[i]))
        else: 
            db1_DeviationIndirect.append(StringToFloat(str1_DeviationIndirect[i]))

    
    del TM.str1_StructuralBehaviourOut
    del TM.str1_DeviationIndirectOut
    
    TM.db1_StructuralBehaviourOut = db1_StructuralBehaviour
    TM.db1_DeviationIndirectOut = db1_DeviationIndirect
# ---------- end topologyparametricvariation_py ----------

# ----
m_nodes = PythonNoHint(M=topologygeneration_py)  # -> L, T
# ---------- m_nodes: Python ----------
if M:
    L = M.pt1_NodeOut
    T = M.str1_NodeOut
# ---------- end m_nodes ----------

planes_ground_level_supports = PlanesGroundLevelSupports(L_2=T_2.pl1_ConstraintPlane, O=pt_groundlevel, L=T)
ground_level_supports = GroundLevelSupports(int=T_2.int1_ConstraintPlane, data=T, pt_groundlevel=pt_groundlevel)  # -> A, D
pln = Plane(flatten(ground_level_supports.D))
int_2 = Integer(flatten(ground_level_supports.A))
int_3 = Integer(T_2.int1_ConstraintPlane)
pln_2 = Plane(planes_ground_level_supports)

tag = TextTag3D(Location=m_nodes.L, Text=m_nodes.T, Size=0.5, Colour=RGB(0, 0, 0), Justification=7)

# ---- group: Topology Constraints
pt = Point([<point referenced from the Rhino model> x4])
topologyconstraints_py = PythonScript(TM=topologyparametricvariation_py, constraintPlane=pln_2, constraintPlaneID=int_3, originNode=pt)  # -> TMC; inputs constraintPlane: list of Plane, constraintPlaneID: list of Int32, originNode: list of Point3d
# ---------- topologyconstraints_py: Python ----------
"""
Define constraint plane and origin nodes
    Inputs:
        TM: (topological diagram) The topological diagram used for the calculation of the structural model
        constraintPlane: (plane) The constraint planes
        constraintPlaneID: (int) The index of the vertices where the constraint planes are applied
        originNode: (point) The origin nodes
    Outputs:
        TMC: (updated topological diagram) The topological diagram updated with the constraints (empty topology on error)
    Remarks:
        This generates a new instance of the topological diagram
"""

__author__    = ['Patrick Ole Ohlbrock','Pierluigi D''Acunto' ]
__copyright__ = 'Copyright 2018 - Chair of Structural Design, ETH Zurich'
__license__   = 'MIT License'
__email__     = 'ohlbrock@arch.ethz.ch'
__version__   = "1.0.0"

"""
If you use the library of CEM in a project, please refer to the CEM GitHub repository:
@misc{cem-dev,
    title  = {{CEM}: Combinatorial Equilibrium Modeling},
    author = {Patrick Ole Ohlbrock and Pierluigi D'Acunto},
    note   = {https://github.com/OleOhlbrock/CEM},
    year   = {2018},
}
"""

import copy

TMC = copy.deepcopy(TM)

if TMC and hasattr(TMC, "db1_StructuralBehaviourOut"):
    if constraintPlane and constraintPlane:
        if len(constraintPlane) == len(constraintPlane):
            TMC.pl1_ConstraintPlaneOut = constraintPlane
            TMC.int1_ConstraintPlaneOut = constraintPlaneID
        else:
            TMC.pl1_ConstraintPlaneOut = None
            TMC.int1_ConstraintPlaneOut = None
    else:
        TMC.pl1_ConstraintPlaneOut = None
        TMC.int1_ConstraintPlaneOut = None
    
    if originNode:
        if len(originNode) == len(TM.pt1_OriginNodeOut):
            TMC.pt1_OriginNodeOut = originNode
# ---------- end topologyconstraints_py ----------

# ----
panel_5 = Panel(topologyparametricvariation_py)

# ---- group: Combinatorial Equlibrium Modelling
self_weight = BooleanToggle(False)
specific_weight_kn_m3 = Slider(500, range=5..500)
yieldstress_kn_m2 = Slider(774688.6, range=50..1000000)
combinatorialequilibriummodelling_py = PythonScript(TMC=topologyconstraints_py, selfWeight=self_weight, yieldStress=yieldstress_kn_m2, specWeight=specific_weight_kn_m3)  # -> out, M; inputs selfWeight: Boolean
# ---------- combinatorialequilibriummodelling_py: Python ----------
"""
Calculate the structural model
    Inputs:
        TMC: (topological diagram) The topological diagram used for the calculation of the structural model
        selfWeight: (bool) Activate the self weight of the structure
        yieldStress: (double) The yield stress of the structural members
        specWeight: (double) The specific weight of the structural members
    Outputs:
        M: (structural model) The calculated structural model (empty model on error)
    Remarks:
        This generates a new instance of the structural model for a given topological diagram
"""

__author__    = ['Patrick Ole Ohlbrock','Pierluigi D''Acunto' ]
__copyright__ = 'Copyright 2018 - Chair of Structural Design, ETH Zurich'
__license__   = 'MIT License'
__email__     = 'ohlbrock@arch.ethz.ch'
__version__   = "1.0.0"

"""
If you use the library of CEM in a project, please refer to the CEM GitHub repository:
@misc{cem-dev,
    title  = {{CEM}: Combinatorial Equilibrium Modeling},
    author = {Patrick Ole Ohlbrock and Pierluigi D'Acunto},
    note   = {https://github.com/OleOhlbrock/CEM},
    year   = {2018},
}
"""


import Rhino.Geometry as rh
import rhinoscriptsyntax as rs
import math
import System.Drawing.Color
import copy
import time


class model(object):
    def __repr__(self):
        return self.ToString()
        
    def __str__(self):
        return self.ToString()
        
    def ToString(self):
        if TMC:
            str0_Description = ""
            if int0_LayerCount:
                str0_Description += "Structural Model\n\nlayers: " + str(int0_LayerCount)
                if pt1_GlobNodeOut and ln1_GlobTrailEdgeOut:
                    str0_Description += "\nvertices: " + str(len(pt1_GlobNodeOut)-int0_TrailNumber) + "\ntrail members: " + str(len(ln1_GlobTrailEdgeOut)-int0_TrailNumber) 
                    if ln1_GlobDeviation1EdgeOut:
                        str0_Description += "\ndirect deviation members: " + str(len(ln1_GlobDeviation1EdgeOut))
                        if ln1_GlobDeviation2EdgeOut:
                            str0_Description += "\nindirect deviation members: " + str(len(ln1_GlobDeviation2EdgeOut))
                    return str0_Description
                else:
                    return "Empty Structural Model"
            else:
                return "Empty Structural Model"

"""
    def ToString(self):
        if hasattr(self, "pt1_GlobNodeOut") and pt1_GlobNodeOut:
            return "Model with " + str(len(pt1_GlobNodeOut)) + " nodes"
        return "Empty model"
"""



### AUXILIARY FUNCTIONS
def ListListToList(xx2_Data):
    xx1_DataOut = []
    for xx1_Data in xx2_Data:
        xx1_DataOut.extend(xx1_Data)
    return xx1_DataOut

def TransposeListList(xx2_Data):
    xx2_DataOut = list(map(list, zip(*xx2_Data)))
    return xx2_DataOut
    
def ListToListList(xx1_Data, int0_R, int0_C):
    xx2_DataOut = []
    for i in xrange(int0_R):
        xx1_DataOut = []
        for j in xrange(int0_C):
            xx1_DataOut.append(xx1_Data[j+i*int0_C])
        xx2_DataOut.append(xx1_DataOut)
    return xx2_DataOut

def DataTreeToListList(dt2_Data):
    xx2_DataOut = []
    for i in xrange(dt2_Data.BranchCount):
        xx1_DataOut = []
        for j in xrange(len(dt2_Data.Branch(i))):
            xx1_DataOut.append(dt2_Data.Branch(i)[j])
        xx2_DataOut.append(xx1_DataOut)
    return xx2_DataOut


M = model()

if TMC and hasattr(TMC, "db1_StructuralBehaviourOut"):
    
    db1_StructuralBehaviour = TMC.db1_StructuralBehaviourOut
    str1_NodeOrderC = TMC.str1_NodeOrderOut
    xx1_Bracing = TMC.db1_DeviationIndirectOut
    pl1_ConstraintPlane = TMC.pl1_ConstraintPlaneOut
    id_NodePlane = TMC.int1_ConstraintPlaneOut
    pt1_OriginNode = TMC.pt1_OriginNodeOut
    str1_Edge = TMC.str1_EdgeOut
    
    

    
    
    ### GLOBAL VARIABLES
    
    # Counters and Tolerance
    int0_Counter = 0
    db0_Divergence = float("inf")
    db0_Threshold = 1e-4
    int0_CounterBracing = 50
    
    int0_TrailNumber = len(pt1_OriginNode)  # input nodes
    int0_C = 3+int0_TrailNumber+1
    int0_R = int(len(db1_StructuralBehaviour)/int0_C)
    db2_StructuralBehaviour = ListToListList(db1_StructuralBehaviour, int0_R, int0_C)
    int0_LayerCount = int(len(db2_StructuralBehaviour)/int0_TrailNumber) # amount of layers
    
    # Global Variables
    vc2_GlobTrailForce = []
    ln2_GlobExtEdge = []
    pt2_GlobNode = []
    pt2_GlobNodeIteration = []
    ln2_GlobTrailEdge = []
    cl2_GlobTrailEdge = []
    db2_GlobTrailEdge = []
    ln2_GlobDeviation1Edge = []
    cl2_GlobDeviation1Edge = []
    db2_GlobDeviation1Edge = []
    ln2_GlobDeviation2Edge = []
    cl2_GlobDeviation2Edge = []
    db2_GlobDeviation2Edge = []
    ln2_GlobExtFOEdge = []
    cl2_GlobExtFOEdge = []
    db2_GlobExtFOEdge = []
    
    
    ### MAIN FUNCTION
    
    def Main(db1_StructuralBehaviour, xx1_Bracing, pt1_OriginNode, pl1_ConstraintPlane):
        
        global int0_Counter     # global counter
        
        g = 0                                   
        ### ITERATE FOR EACH LAYER OF THE STRUCTURE
        
        ## Initialize
        pt1_InputNode = []
        
        for g in xrange(int0_LayerCount):
            
            vc1_TrailForceIn = []
            
            if g == 0:
                pt1_InputNode = pt1_OriginNode
                for i in xrange(int0_TrailNumber):
                    vc1_TrailForceIn.append(rh.Vector3d(0,0,0)) 
            else:
                pt1_InputNode = pt2_GlobNode[g-1]
                for i in xrange(int0_TrailNumber):
                    vc1_TrailForceIn.append(-vc2_GlobTrailForce[g-1][i])
        
            ### LAYER DEVELOPMENT
            
            ## Initialize Layer
            
            # Create Deviation Length and Unit Vector Matrix
            vc2_DevLengthVector = []
            vc2_DevUnitVector = []
            
            for i in xrange(int0_TrailNumber):
                vc1_DevLengthVector = []
                vc1_DevUnitVector = []
                for j in xrange(int0_TrailNumber):
                    vc0_DevLengthVector = rh.Vector3d(pt1_InputNode[j]-pt1_InputNode[i])
                    vc0_DevUnitVector = rh.Vector3d(vc0_DevLengthVector)
                    rh.Vector3d.Unitize(vc0_DevUnitVector)
                    vc1_DevLengthVector.append(vc0_DevLengthVector)
                    vc1_DevUnitVector.append(vc0_DevUnitVector)
                vc2_DevLengthVector.append(vc1_DevLengthVector)
                vc2_DevUnitVector.append(vc1_DevUnitVector)
            
            
            ### MAIN FUNCTION
            
            # Create List of External Forces
            # list for external and bracing forces
            db1_ExtForceX = []
            db1_ExtForceY = []
            db1_ExtForceZ = []
            
            # list for external forces only
            db1_ExtFOX = []
            db1_ExtFOY = []
            db1_ExtFOZ = []
            
            # Add External Forces from Matrix    
            for i in xrange(g*int0_TrailNumber,(g+1)*int0_TrailNumber):
                db1_ExtFOX.append(db2_StructuralBehaviour[i][0])
                db1_ExtFOY.append(db2_StructuralBehaviour[i][1])
                db1_ExtFOZ.append(db2_StructuralBehaviour[i][2])
                
            for i in xrange(g*int0_TrailNumber,(g+1)*int0_TrailNumber):
                db1_ExtForceX.append(db2_StructuralBehaviour[i][0])
                db1_ExtForceY.append(db2_StructuralBehaviour[i][1])
                db1_ExtForceZ.append(db2_StructuralBehaviour[i][2])
                
                # Add Magnitudes of Bracing Forces as External Forces
                # Start node of bracing
                if int0_Counter != 0:
                    for j in xrange(0,len(xx1_Bracing),3):
                        int0_BracingFromLayerIndex = int(xx1_Bracing[j]) // int0_TrailNumber
                        if i == int(xx1_Bracing[j]):
                            pt0_BracingFrom = pt2_GlobNodeIteration[g][i-g*int0_TrailNumber]
                            int0_BracingToLayerIndex = int(xx1_Bracing[j+1]) // int0_TrailNumber
                            int0_BracingToTrailIndex = int(xx1_Bracing[j+1]) % int0_TrailNumber
                            pt0_BracingTo = pt2_GlobNodeIteration[int0_BracingToLayerIndex][int0_BracingToTrailIndex]
                            vc0_ForceA = rh.Vector3d(pt0_BracingTo-pt0_BracingFrom)
                            rh.Vector3d.Unitize(vc0_ForceA)
                            vc0_ForceA = float(xx1_Bracing[j+2])*vc0_ForceA
                            db1_ExtForceX[i-g*int0_TrailNumber] += vc0_ForceA.X
                            db1_ExtForceY[i-g*int0_TrailNumber] += vc0_ForceA.Y
                            db1_ExtForceZ[i-g*int0_TrailNumber] += vc0_ForceA.Z
                            
                # End node of bracing
                if int0_Counter != 0:
                    for j in xrange(1,len(xx1_Bracing),3):
                        int0_BracingFromLayerIndex = int(xx1_Bracing[j]) // int0_TrailNumber
                        if i == int(xx1_Bracing[j]):
                            pt0_BracingFrom = pt2_GlobNodeIteration[g][i-g*int0_TrailNumber]
                            int0_BracingToLayerIndex = int(xx1_Bracing[j-1]) // int0_TrailNumber
                            int0_BracingToTrailIndex = int(xx1_Bracing[j-1]) % int0_TrailNumber
                            pt0_BracingTo = pt2_GlobNodeIteration[int0_BracingToLayerIndex][int0_BracingToTrailIndex]
                            vc0_ForceA = rh.Vector3d(pt0_BracingTo-pt0_BracingFrom)
                            rh.Vector3d.Unitize(vc0_ForceA)
                            vc0_ForceA = float(xx1_Bracing[j+1])*vc0_ForceA
                            db1_ExtForceX[i-g*int0_TrailNumber] += vc0_ForceA.X
                            db1_ExtForceY[i-g*int0_TrailNumber] += vc0_ForceA.Y
                            db1_ExtForceZ[i-g*int0_TrailNumber] += vc0_ForceA.Z
            
            # Vector sum of external and bracing forces for the equilibrium calculation
            vc1_ExtForce = []
            for i in xrange(int0_TrailNumber):
                vc0_ExtForce = rh.Vector3d(db1_ExtForceX[i],db1_ExtForceY[i],db1_ExtForceZ[i])
                vc1_ExtForce.append(vc0_ExtForce)
            
            # Vector sum of external forces only for visualization
            vc1_ExtFO = []
            for i in xrange(int0_TrailNumber):
                vc0_ExtFO = rh.Vector3d(db1_ExtFOX[i],db1_ExtFOY[i],db1_ExtFOZ[i])
                vc1_ExtFO.append(vc0_ExtFO)
            
            # Add External Forces to the Form Diagram
            ln1_ExtFOEdge = []
            cl1_ExtFOEdge = []
            db1_ExtFOEdge = []
            
            for i in xrange(len(vc1_ExtFO)):
                ln1_ExtFOEdge.append(rh.Line(pt1_InputNode[i],(pt1_InputNode[i] + vc1_ExtFO[i])))
                cl1_ExtFOEdge.append(System.Drawing.Color.DarkGreen)
                db1_ExtFOEdge.append(abs(vc1_ExtFO[i].Length))
            
            # Extract Deviation Matrix
            db2_DevForceMag = []
            
            for i in xrange(g*int0_TrailNumber,(g+1)*int0_TrailNumber):
                db1_DevForceMag = []
                for j in xrange(3,int0_TrailNumber+3):
                    db1_DevForceMag.append(db2_StructuralBehaviour[i][j])
                db2_DevForceMag.append(db1_DevForceMag)
            
            # Create Trail Length and Static Action Matrix from Input Origin Points
            db1_TrailLength = []
            db1_TrailStatAct = []
            
            for i in xrange(g*int0_TrailNumber,(g+1)*int0_TrailNumber):
                db1_TrailLength.append(db2_StructuralBehaviour[i][int0_TrailNumber+3])
                if g == 0:
                    db1_TrailStatAct.append(0)
                else:
                    db1_TrailStatAct.append(abs((db2_StructuralBehaviour[i-int0_TrailNumber][int0_TrailNumber+3]*vc1_TrailForceIn[i-g*int0_TrailNumber]).Length))
            
            
            # Calculate Hadamard Product of Deviation Length Matrix and Deviation Matrix
            vc2_DevForce = []
            db2_DevStatAct = []
            
            for i in xrange(int0_TrailNumber):
                vc1_DevForce = []
                db1_DevStatAct = []
                for j in xrange(int0_TrailNumber):
                    vc0_DevForce = vc2_DevUnitVector[i][j]*db2_DevForceMag[i][j]
                    db0_DevStatAct = abs((vc2_DevLengthVector[i][j]*db2_DevForceMag[i][j]).Length)
                    vc1_DevForce.append(vc0_DevForce)
                    db1_DevStatAct.append(db0_DevStatAct)
                vc2_DevForce.append(vc1_DevForce)
                db2_DevStatAct.append(db1_DevStatAct)
            
            
            # Sum Deviation Vectors and Static Action per each Node
            vc1_DevForceSum = []
            db1_DevStatActSum = []
            db1_IndDevStatActSum = []
            
            for i in xrange(int0_TrailNumber):
                vc0_DevForceSum = rh.Vector3d(0,0,0)
                db0_DevStatActSum = 0
                for j in xrange(int0_TrailNumber):
                    vc0_DevForceSum += vc2_DevForce[i][j]
                    db0_DevStatActSum += db2_DevStatAct[i][j]
                vc1_DevForceSum.append(vc0_DevForceSum)
                db1_DevStatActSum.append(db0_DevStatActSum)
            # Get Static Action per Node for Indirect Deviations
            # Start Node of Inderect Deviations
            if selfWeight and specWeight and yieldStress:
                int1_StartBracingIndex = []
                int1_EndBracingIndex = []
                db1_BracingValue = []
                for i in xrange(0,len(xx1_Bracing),3):
                    int1_StartBracingIndex.append(int(xx1_Bracing[i]))
                    int1_EndBracingIndex.append(int(xx1_Bracing[i+1]))
                    db1_BracingValue.append(float(xx1_Bracing[i+2]))
                for i in xrange(int0_TrailNumber):
                    if int0_Counter != 0:
                        int1_StartBracingIndex_C = int1_StartBracingIndex[:]
                        int1_EndBracingIndex_C = int1_EndBracingIndex[:]
                        db1_BracingValue_C = db1_BracingValue[:]
                        db0_IndDevStatActSum = 0
                        for j in int1_StartBracingIndex:
                            if g*int0_TrailNumber + i == j:
                                int0_StartBracingIndex = int1_StartBracingIndex_C.index(g*int0_TrailNumber + i)
                                int0_StartBracingGlobIndex = g*int0_TrailNumber + i
                                int0_EndBracingGlobIndex = int1_EndBracingIndex_C[ int0_StartBracingIndex ]
                                db0_ValueBracingGlobIndex = db1_BracingValue_C[ int0_StartBracingIndex ]
                                int1_StartBracingIndex_C.pop( int0_StartBracingIndex )
                                int1_EndBracingIndex_C.pop( int0_StartBracingIndex )
                                db1_BracingValue_C.pop( int0_StartBracingIndex )
                                # Get Start and End Nodes of Bracing
                                int0_StartBracingLayer = g
                                int0_StartBracingTrail = i
                                int0_EndBracingLayer = int0_EndBracingGlobIndex // int0_TrailNumber
                                int0_EndBracingTrail = int0_EndBracingGlobIndex % int0_TrailNumber
                                pt0_StartBracing = pt2_GlobNodeIteration[int0_StartBracingLayer][int0_StartBracingTrail]
                                pt0_EndBracing = pt2_GlobNodeIteration[int0_EndBracingLayer][int0_EndBracingTrail]
                                db0_IndDevStatActSum += abs(db0_ValueBracingGlobIndex*pt0_StartBracing.DistanceTo(pt0_EndBracing))
                        db1_IndDevStatActSum.append(db0_IndDevStatActSum)
                            
                # End Node of Inderect Deviations
                int1_StartBracingIndex = []
                int1_EndBracingIndex = []
                db1_BracingValue = []
                for i in xrange(1,len(xx1_Bracing),3):
                    int1_StartBracingIndex.append(int(xx1_Bracing[i-1]))
                    int1_EndBracingIndex.append(int(xx1_Bracing[i]))
                    db1_BracingValue.append(float(xx1_Bracing[i+1]))
                for i in xrange(int0_TrailNumber):
                    if int0_Counter != 0:
                        int1_StartBracingIndex_C = int1_StartBracingIndex[:]
                        int1_EndBracingIndex_C = int1_EndBracingIndex[:]
                        db1_BracingValue_C = db1_BracingValue[:]
                        db0_IndDevStatActSum = 0
                        for j in int1_EndBracingIndex:
                            if g*int0_TrailNumber + i == j:
                                int0_EndBracingIndex = int1_EndBracingIndex_C.index(g*int0_TrailNumber + i)
                                int0_EndBracingGlobIndex = g*int0_TrailNumber + i
                                int0_StartBracingGlobIndex = int1_StartBracingIndex_C[ int0_EndBracingIndex ]
                                db0_ValueBracingGlobIndex = db1_BracingValue_C[ int0_EndBracingIndex ]
                                int1_StartBracingIndex_C.pop( int0_EndBracingIndex )
                                int1_EndBracingIndex_C.pop( int0_EndBracingIndex )
                                db1_BracingValue_C.pop( int0_EndBracingIndex )
                                # Get Start and End Nodes of Bracing
                                int0_EndBracingLayer = g
                                int0_EndBracingTrail = i
                                int0_StartBracingLayer = int0_StartBracingGlobIndex // int0_TrailNumber
                                int0_StartBracingTrail = int0_StartBracingGlobIndex % int0_TrailNumber
                                pt0_StartBracing = pt2_GlobNodeIteration[int0_StartBracingLayer][int0_StartBracingTrail]
                                pt0_EndBracing = pt2_GlobNodeIteration[int0_EndBracingLayer][int0_EndBracingTrail]
                                db0_IndDevStatActSum += abs(db0_ValueBracingGlobIndex*pt0_StartBracing.DistanceTo(pt0_EndBracing))
                        db1_IndDevStatActSum[i] += db0_IndDevStatActSum
            else:
                db1_IndDevStatActSum = 0
            # Construct Equilibrium per each Node
            vc1_TrailForceOut = []
            vc1_SelfWeight = []
            for i in xrange(int0_TrailNumber):
                if int0_Counter == 0:
                    db1_IndDevStatActSum = [0.0 for i in range(int0_TrailNumber)]
                if selfWeight and specWeight and yieldStress:
                    vc0_SelfWeight = rh.Vector3d(((db1_TrailStatAct[i] + db1_DevStatActSum[i]/2 + db1_IndDevStatActSum[i]/2 )*specWeight/yieldStress)*(-rh.Vector3d.ZAxis))
                    vc0_TrailForceOut = -(vc1_ExtForce[i] + vc1_DevForceSum[i] + vc1_TrailForceIn[i] + vc0_SelfWeight)
                    vc1_TrailForceOut.append(vc0_TrailForceOut)
                    vc1_SelfWeight.append(vc0_SelfWeight)
                else:
                    vc0_TrailForceOut = -(vc1_ExtForce[i] + vc1_DevForceSum[i] + vc1_TrailForceIn[i])
                    vc1_TrailForceOut.append(vc0_TrailForceOut)
    
            
            # Add Self Weight to the Form Diagram
            # external force plus self-weight
            for i in xrange(len(vc1_SelfWeight)):
                ln1_ExtFOEdge.append(rh.Line(pt1_InputNode[i],(pt1_InputNode[i] + vc1_SelfWeight[i])))
                cl1_ExtFOEdge.append(System.Drawing.Color.DarkGreen)
                db1_ExtFOEdge.append(abs(vc1_SelfWeight[i].Length))
            
            
            ## Construction Form Diagram
            
            # Find New Nodes
           
            pt1_Node = []
            for i in xrange(int0_TrailNumber):
                vc0_TrailForceOutUn = rh.Vector3d(vc1_TrailForceOut[i])
                rh.Vector3d.Unitize(vc0_TrailForceOutUn)
                ln0_TrailOut = rh.Line(pt1_InputNode[i],vc0_TrailForceOutUn)
                pt0_Node = pt1_InputNode[i] + vc0_TrailForceOutUn*db1_TrailLength[i]
                pt1_Node.append(pt0_Node)
                
                # Modify result in case of constraint planes
                if pl1_ConstraintPlane:
                    if g != int0_LayerCount-1:
                        for j in xrange(len(id_NodePlane)):
                            if int(str1_NodeOrderC[((g+1)*int0_TrailNumber)+i]) == int(id_NodePlane[j]):
                                pl0_PlaneTrailOut = pl1_ConstraintPlane[j]
                                if pl0_PlaneTrailOut is not None:
                                    xx1_Intersect = rh.Intersect.Intersection.LinePlane(ln0_TrailOut,pl0_PlaneTrailOut)
                                    bl0_Intersect = xx1_Intersect[0]
                                    db0_Intersect = xx1_Intersect[1]
                                    if abs(db0_Intersect) < abs(db0_Threshold):
                                        db1_TrailLength[i] = 0.0
                                        pt0_Node = pt1_InputNode[i]
                                    if bl0_Intersect and abs(db0_Intersect) > abs(db0_Threshold):
                                        pt0_Node = ln0_TrailOut.PointAt(db0_Intersect)
                                        db1_TrailLength[i] = pt1_InputNode[i].DistanceTo(pt0_Node)*db0_Intersect/abs(db0_Intersect)
                        pt1_Node[len(pt1_Node)-1] = pt0_Node
                
            # Build Trail Edges
            ln1_TrailEdge = []
            cl1_TrailEdge = []
            db1_TrailEdge = []
            
            for i in xrange(int0_TrailNumber):
                ln0_TrailEdge = rh.Line(pt1_InputNode[i],pt1_Node[i])
                ln1_TrailEdge.append(ln0_TrailEdge)
                if db1_TrailLength[i] > 0:
                    cl1_TrailEdge.append(System.Drawing.Color.Red)
                elif db1_TrailLength[i] < 0:
                    cl1_TrailEdge.append(System.Drawing.Color.Blue)
                else:
                    cl1_TrailEdge.append(System.Drawing.Color.Black)
                db1_TrailEdge.append(abs(vc1_TrailForceOut[i].Length))
    
            # Build Deviation Edges
            ln1_Deviation1Edge = []
            cl1_Deviation1Edge = []
            db1_Deviation1Edge = []
            k = 3
            
            for i in xrange(g*int0_TrailNumber,(g+1)*int0_TrailNumber):
                k += 1
                for j in xrange(k,int0_TrailNumber+3):
                    if db2_StructuralBehaviour[i][j] != 0:
                        ln0_Deviation1Edge = rh.Line(pt1_InputNode[i % int0_TrailNumber],pt1_InputNode[j-3])
                        ln1_Deviation1Edge.append(ln0_Deviation1Edge)
                        if db2_StructuralBehaviour[i][j] > 0:
                            cl1_Deviation1Edge.append(System.Drawing.Color.Red)
                        else:
                            cl1_Deviation1Edge.append(System.Drawing.Color.Blue)
                        db1_Deviation1Edge.append(abs(db2_StructuralBehaviour[i][j]))
            
            vc2_GlobTrailForce.append(vc1_TrailForceOut)
            
            # Form Diagram
            ln2_GlobTrailEdge.append(ln1_TrailEdge)
            db2_GlobTrailEdge.append(db1_TrailEdge)
            ln2_GlobDeviation1Edge.append(ln1_Deviation1Edge)
            cl2_GlobDeviation1Edge.append(cl1_Deviation1Edge)
            db2_GlobDeviation1Edge.append(db1_Deviation1Edge)
            ln2_GlobExtFOEdge.append(ln1_ExtFOEdge)
            cl2_GlobExtFOEdge.append(cl1_ExtFOEdge)
            db2_GlobExtFOEdge.append(db1_ExtFOEdge)
            pt2_GlobNode.append(pt1_Node)
            cl2_GlobTrailEdge.append(cl1_TrailEdge)
    
            g += 1
        
        # Add Reactions to Form Diagram
        for i in xrange(len(vc2_GlobTrailForce[g-1])):
            if selfWeight and specWeight and yieldStress:
                vc0_SelfWeight = (abs(vc2_GlobTrailForce[g-1][i].Length*ln2_GlobTrailEdge[g-1][i].Length)*specWeight/yieldStress)*(-rh.Vector3d.ZAxis)
                if cl2_GlobTrailEdge[g-1][i] != System.Drawing.Color.Blue:
                    ln1_ExtFOEdge.append(rh.Line(pt2_GlobNode[g-1][i],(pt2_GlobNode[g-1][i] + vc2_GlobTrailForce[g-1][i] + vc0_SelfWeight)))
                    db1_ExtFOEdge.append(abs(ln1_ExtFOEdge[len(ln1_ExtFOEdge)-1].Length))
                else:
                    ln1_ExtFOEdge.append(rh.Line((pt2_GlobNode[g-1][i] - vc2_GlobTrailForce[g-1][i] + vc0_SelfWeight),pt2_GlobNode[g-1][i]))
                    db1_ExtFOEdge.append(abs(ln1_ExtFOEdge[len(ln1_ExtFOEdge)-1].Length))
            else:
                if cl2_GlobTrailEdge[g-1][i] != System.Drawing.Color.Blue:
                    ln1_ExtFOEdge.append(rh.Line(pt2_GlobNode[g-1][i],(pt2_GlobNode[g-1][i] + vc2_GlobTrailForce[g-1][i])))
                    db1_ExtFOEdge.append(abs(ln1_ExtFOEdge[len(ln1_ExtFOEdge)-1].Length))
                else:
                    ln1_ExtFOEdge.append(rh.Line((pt2_GlobNode[g-1][i] - vc2_GlobTrailForce[g-1][i]),pt2_GlobNode[g-1][i]))
                    db1_ExtFOEdge.append(abs(ln1_ExtFOEdge[len(ln1_ExtFOEdge)-1].Length))
            cl1_ExtFOEdge.append(System.Drawing.Color.DarkGreen)
    
        # Update Counter
        int0_Counter += 1
        
        return
    
    # Initialization of Nodes' Position
    
    for j in xrange(int0_LayerCount+1):
        pt1_GlobNodeIteration = []
        pt2_GlobNodeIteration.append(pt1_GlobNodeIteration)
    
    # Initial Check
    int0_StructuralLayersMatrix = int(len(db1_StructuralBehaviour)/(3+len(pt1_OriginNode)+1)/len(pt1_OriginNode))
    if db1_StructuralBehaviour == None or int0_StructuralLayersMatrix == 0:
        print(str("Please input Matrix of Structural Behaviour"))
        if len(pt1_OriginNode) == 0:
            print(str("Please input Origin Points"))
    else:
        if len(pt1_OriginNode) == 0:
            print(str("Please input Origin Points"))
        else:
            print("Iteration report")
    
            # Start Iteration
            while int0_Counter < int0_CounterBracing and db0_Divergence > db0_Threshold:
                
                # Call Main Function
                Main(db1_StructuralBehaviour, xx1_Bracing, pt1_OriginNode, pl1_ConstraintPlane)
                
                # Store Nodes' Position
                pt2_GlobNodeIteration[0] = pt1_OriginNode
                for j in xrange(1,len(pt2_GlobNode)+1):
                    if int0_Counter-1 != 0:
                        db0_Divergence = 0
                        for k in xrange(len(pt2_GlobNode[j-1])):
                            db0_Divergence += pt2_GlobNode[j-1][k].DistanceTo(pt2_GlobNodeIteration[j][k])
                    pt2_GlobNodeIteration[j] = pt2_GlobNode[j-1]
                
                print(str(int0_Counter))
                print(str(db0_Divergence))
                print(str("______"))
                if int0_Counter < int0_CounterBracing and db0_Divergence > db0_Threshold:
                    # Re-Inatialize Global Variables
                    dbl0_Divergence = 0
                    vc2_GlobTrailForce = []
                    ln2_GlobExtEdge = []
                    pt2_GlobNode = []
                    ln2_GlobTrailEdge = []
                    cl2_GlobTrailEdge = []
                    db2_GlobTrailEdge = []
                    ln2_GlobDeviation1Edge = []
                    cl2_GlobDeviation1Edge = []
                    db2_GlobDeviation1Edge = []
                    ln2_GlobDeviation2Edge = []
                    cl2_GlobDeviation2Edge = []
                    db2_GlobDeviation2Edge = []
                    ln2_GlobExtFOEdge = []
                    cl2_GlobExtFOEdge = []
                    db2_GlobExtFOEdge = []
    
                if int0_Counter == int0_CounterBracing or db0_Divergence < db0_Threshold:
                    
                    # Add Bracing
                    ln1_Deviation2Edge = []
                    cl1_Deviation2Edge = []
                    db1_Deviation2Edge = []
                    for i in xrange(0,len(xx1_Bracing),3):
                        int0_BracingFromLayerIndex = int(xx1_Bracing[i]) // int0_TrailNumber
                        int0_BracingFromTrailIndex = int(xx1_Bracing[i]) % int0_TrailNumber
                        int0_BracingToLayerIndex = int(xx1_Bracing[i+1]) // int0_TrailNumber
                        int0_BracingToTrailIndex = int(xx1_Bracing[i+1]) % int0_TrailNumber
                        ln0_Deviation2Edge = rh.Line(pt2_GlobNodeIteration[int0_BracingFromLayerIndex][int0_BracingFromTrailIndex],pt2_GlobNodeIteration[int0_BracingToLayerIndex][int0_BracingToTrailIndex])
                        ln1_Deviation2Edge.append(ln0_Deviation2Edge)
                        if float(xx1_Bracing[i+2]) > 0:
                            cl1_Deviation2Edge.append(System.Drawing.Color.Red)
                        elif float(xx1_Bracing[i+2]) < 0:
                            cl1_Deviation2Edge.append(System.Drawing.Color.Blue)
                        else:
                            cl1_Deviation2Edge.append(System.Drawing.Color.Black)
                        db1_Deviation2Edge.append(xx1_Bracing[i+2])
    
                    ### OUTMUT
    
                    ln1_GlobExtEdgeOut = ListListToList(ln2_GlobExtEdge)
                    pt1_GlobNodeOut = ListListToList(pt2_GlobNodeIteration)
                    ln1_GlobTrailEdgeOut = ListListToList(ln2_GlobTrailEdge)
                    cl1_GlobTrailEdgeOut = ListListToList(cl2_GlobTrailEdge)
                    db1_GlobTrailEdgeOut = ListListToList(db2_GlobTrailEdge)
                    ln1_GlobDeviation1EdgeOut = ListListToList(ln2_GlobDeviation1Edge)
                    cl1_GlobDeviation1EdgeOut = ListListToList(cl2_GlobDeviation1Edge)
                    db1_GlobDeviation1EdgeOut = ListListToList(db2_GlobDeviation1Edge)
                    ln1_GlobDeviation2EdgeOut = ln1_Deviation2Edge
                    cl1_GlobDeviation2EdgeOut = cl1_Deviation2Edge
                    db1_GlobDeviation2EdgeOut = db1_Deviation2Edge
                    ln1_GlobExtFOEdgeOut = ListListToList(ln2_GlobExtFOEdge)
                    cl1_GlobExtFOEdgeOut = ListListToList(cl2_GlobExtFOEdge)
                    db1_GlobExtFOEdgeOut = ListListToList(db2_GlobExtFOEdge)
                    
                    M.ln1_GlobExtEdgeOut = ln1_GlobExtEdgeOut
                    M.pt1_GlobNodeOut = pt1_GlobNodeOut
                    M.ln1_GlobTrailEdgeOut = ln1_GlobTrailEdgeOut
                    M.cl1_GlobTrailEdgeOut = cl1_GlobTrailEdgeOut
                    M.db1_GlobTrailEdgeOut = db1_GlobTrailEdgeOut
                    M.ln1_GlobDeviation1EdgeOut = ln1_GlobDeviation1EdgeOut
                    M.cl1_GlobDeviation1EdgeOut = cl1_GlobDeviation1EdgeOut
                    M.db1_GlobDeviation1EdgeOut = db1_GlobDeviation1EdgeOut
                    M.ln1_GlobDeviation2EdgeOut = ln1_GlobDeviation2EdgeOut
                    M.cl1_GlobDeviation2EdgeOut = cl1_GlobDeviation2EdgeOut
                    M.db1_GlobDeviation2EdgeOut = db1_GlobDeviation2EdgeOut
                    M.ln1_GlobExtFOEdgeOut = ln1_GlobExtFOEdgeOut
                    M.cl1_GlobExtFOEdgeOut = cl1_GlobExtFOEdgeOut
                    M.db1_GlobExtFOEdgeOut = db1_GlobExtFOEdgeOut
                    M.str1_NodeOrderOut = str1_NodeOrderC
                    M.str1_EdgeOut = str1_Edge
# ---------- end combinatorialequilibriummodelling_py ----------
# ----
panel_6 = Panel(combinatorialequilibriummodelling_py.M)
panel_7 = Panel(combinatorialequilibriummodelling_py.out)

# ---- group: Visualization
scale_external_forces = Slider(0.52, range=0..1)
text_size = Slider(0, range=0..1)
edge_thickness = Slider(0.03, range=0..1)
visualization = Visualization_2(M=combinatorialequilibriummodelling_py.M, db0_scale_extforce=scale_external_forces)  # -> gm1_formdiagram, cl1_formdiagram, db0_forcemagn, pt1_formnode, str1_nodeorderout
preview = CustomPreview(Geometry=visualization.gm1_formdiagram, Material=visualization.cl1_formdiagram)

# ----
multiplication = Multiplication(A=visualization.db0_forcemagn, B=edge_thickness)

# ---- group: Visualization (continued)
preview_thickness = CSharpScript(
    ln0_E_v=visualization.gm1_formdiagram,
    cl0_E_v=visualization.cl1_formdiagram,
    pt0_N_v=visualization.pt1_formnode,
    st0_N_v=visualization.str1_nodeorderout,
    db0_Txt_Size=text_size,
    db0_Line_Thick=multiplication)  # inputs ln0_E_v: Line, cl0_E_v: Color, pt0_N_v: Point3d, st0_N_v: String, db0_Txt_Size: Double, db0_Line_Thick: Double
# ---------- preview_thickness: C# usings ----------
using System.IO;
using System.Linq;
using System.Data;
using System.Drawing;
using System.Reflection;
using System.Windows.Forms;
using System.Xml;
using System.Xml.Linq;
using System.Runtime.InteropServices;

using Rhino.DocObjects;
using Rhino.Collections;
using GH_IO;
using GH_IO.Serialization;
# ---------- preview_thickness: C# ----------
    ln1_Edge_t.Add(ln0_E_v);
    cl1_Color_Edge_t.Add(cl0_E_v);
    pt1_Vertex_t.Add(pt0_N_v);
    st1_Tag_Vertex_t.Add(st0_N_v);
    db1_Txt_Size_t.Add(db0_Txt_Size);
    db1_Line_Thick_t.Add(db0_Line_Thick);
# ---------- preview_thickness: C# additional code ----------
  private readonly List<Line> ln1_Edge_t = new List<Line>();
  private readonly List<Color> cl1_Color_Edge_t = new List<Color>();
  private readonly List<Point3d> pt1_Vertex_t = new List<Point3d>();
  private readonly List<string> st1_Tag_Vertex_t = new List<string>();
  private readonly List<double> db1_Txt_Size_t = new List<double>();
  private readonly List<double> db1_Line_Thick_t = new List<double>();

  public override void BeforeRunScript()
  {
    ln1_Edge_t.Clear();
    cl1_Color_Edge_t.Clear();
    pt1_Vertex_t.Clear();
    st1_Tag_Vertex_t.Clear();
    db1_Txt_Size_t.Clear();
    db1_Line_Thick_t.Clear();
  }

  public override BoundingBox ClippingBox
  {
    get
    {
      return BoundingBox.Empty;
    }
  }
  public override void DrawViewportWires(IGH_PreviewArgs args)
  {

    Plane pl0_Plane_Edge;
    args.Viewport.GetFrustumFarPlane(out pl0_Plane_Edge);

    for (int int0_i = 0; int0_i < ln1_Edge_t.Count; int0_i++)
    {
      Line ln0_Edge = ln1_Edge_t[int0_i];
      Color cl0_Color_Edge = cl1_Color_Edge_t[int0_i];
      double db0_Txt_Size = db1_Txt_Size_t[int0_i];
      double db0_Line_Thick = db1_Line_Thick_t[int0_i];

      args.Display.DrawLine(ln0_Edge, cl0_Color_Edge, Convert.ToInt32(1 + 10 * db0_Line_Thick));
    }

    if (st1_Tag_Vertex_t.Count == 0)
      return;

    Plane pl0_Plane_Vertex;
    args.Viewport.GetFrustumFarPlane(out pl0_Plane_Vertex);

    for (int int0_i = 0; int0_i < st1_Tag_Vertex_t.Count; int0_i++)
    {
      Point3d pt0_Vertex = pt1_Vertex_t[int0_i];
      string st0_Text_Vertex = st1_Tag_Vertex_t[int0_i];
      pl0_Plane_Vertex.Origin = pt0_Vertex;
      double db0_Txt_Size = db1_Txt_Size_t[int0_i];

      args.Display.DrawPoint(pt0_Vertex, Rhino.Display.PointStyle.X, (int) (20 * db0_Txt_Size), System.Drawing.Color.Black);
      Rhino.Display.Text3d drawText = new Rhino.Display.Text3d(st0_Text_Vertex, pl0_Plane_Vertex, db0_Txt_Size);
      args.Display.Draw3dText(drawText, System.Drawing.Color.Black);
      drawText.Dispose();
    }
  }
# ---------- end preview_thickness ----------

# ==== cluster Cluster
line = ClusterInput()
num = ClusterInput()
num_2 = ClusterInput()
num_3 = ClusterInput()
line_2 = Line(line)
num_4 = Number(num_2)
num_5 = Number(num_3)
num_6 = Number(num)
split = SplitList(List=line_2, Index=1)  # -> ListA, ListB
split_2 = SplitList(List=reverse(split.ListB), Index=1)  # -> ListA, ListB
line_3 = Line(split_2.ListA)
line_4 = Line(split_2.ListB)
split_3 = SplitList(List=line_4, Index=1)  # -> ListA, ListB
line_5 = Line(split.ListA)
split_4 = SplitList(List=reverse(split_3.ListB), Index=1)  # -> ListA, ListB
line_6 = Line(split_3.ListA)
explode = Explode(Curve=line_4, Recursive=True)  # -> Segments, Vertices
explode_2 = Explode(Curve=line_5, Recursive=True)  # -> Segments, Vertices
explode_3 = Explode(Curve=line_3, Recursive=True)  # -> Segments, Vertices
line_7 = Line(split_4.ListA)
line_8 = Line(split_4.ListB)
dev_t12_start = Line(flatten([explode_2.Segments, explode_3.Segments]))
line_9 = Line(flatten([line_6, line_7]))
dev_t12_m = Line(flatten(line_8))
python = GhPythonScript(start=flatten(line_9), m=flatten(dev_t12_m), end=flatten(dev_t12_start), para_Start=num_4, para_m=num_6, para_End=num_5)  # -> out, lines, attributes; inputs start: list of Line, m: list of Line, end: list of Line
# ---------- python: Python ----------
__author__ = "opatrick"
__version__ = "2018.09.14"

import rhinoscriptsyntax as rs
lines = []
attributes = []

for i in xrange(0,len(start),1):
    if para_Start != 0:
        lines.append(start[i])
        attributes.append(para_Start)
        
for i in xrange(0,len(m),1):
    if para_m != 0:
        lines.append(m[i])
        attributes.append(para_m)

for i in xrange(0,len(end),1):
    if para_End != 0:
        lines.append(end[i])
        attributes.append(para_End)
# ---------- end python ----------
lines = ClusterOutput(python.lines)
attributes = ClusterOutput(python.attributes)

# ==== cluster Visualization_2
db0_scale_extforce = ClusterInput()
M = ClusterInput()
cem = PythonScript(M=M)  # -> ln1_GlobTrailEdgeOut, cl1_GlobTrailEdgeOut, db1_GlobTrailEdgeOut, ln1_GlobDeviation1EdgeOut, cl1_GlobDeviation1EdgeOut, db1_GlobDeviation1EdgeOut, ln1_GlobDeviation2EdgeOut, cl1_GlobDeviation2EdgeOut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
# ---------- cem: Python ----------
ln1_GlobExtEdgeOut = M.ln1_GlobExtEdgeOut
pt1_GlobNodeOut = M.pt1_GlobNodeOut
ln1_GlobTrailEdgeOut = M.ln1_GlobTrailEdgeOut
cl1_GlobTrailEdgeOut = M.cl1_GlobTrailEdgeOut
db1_GlobTrailEdgeOut = M.db1_GlobTrailEdgeOut
ln1_GlobDeviation1EdgeOut = M.ln1_GlobDeviation1EdgeOut
cl1_GlobDeviation1EdgeOut = M.cl1_GlobDeviation1EdgeOut
db1_GlobDeviation1EdgeOut = M.db1_GlobDeviation1EdgeOut
ln1_GlobDeviation2EdgeOut = M.ln1_GlobDeviation2EdgeOut
cl1_GlobDeviation2EdgeOut = M.cl1_GlobDeviation2EdgeOut
db1_GlobDeviation2EdgeOut = M.db1_GlobDeviation2EdgeOut
ln1_GlobExtFOEdgeOut = M.ln1_GlobExtFOEdgeOut
cl1_GlobExtFOEdgeOut = M.cl1_GlobExtFOEdgeOut
db1_GlobExtFOEdgeOut = M.db1_GlobExtFOEdgeOut
str1_NodeOrderOut = M.str1_NodeOrderOut
str1_EdgeOut = M.str1_EdgeOut
# ---------- end cem ----------
merge = Merge(Data1=graft(cem.ln1_GlobTrailEdgeOut), Data2=graft(cem.cl1_GlobTrailEdgeOut), Data3=graft(cem.db1_GlobTrailEdgeOut))
merge_2 = Merge(
    Data1=graft(cem.ln1_GlobDeviation1EdgeOut),
    Data2=graft(cem.cl1_GlobDeviation1EdgeOut),
    Data3=graft(cem.db1_GlobDeviation1EdgeOut))
merge_3 = Merge(
    Data1=graft(cem.ln1_GlobDeviation2EdgeOut),
    Data2=graft(cem.cl1_GlobDeviation2EdgeOut),
    Data3=graft(cem.db1_GlobDeviation2EdgeOut))
merge_4 = Merge(Data1=graft(cem.ln1_GlobExtFOEdgeOut), Data2=graft(cem.cl1_GlobExtFOEdgeOut), Data3=graft(cem.db1_GlobExtFOEdgeOut))
visualization = Visualization(data=merge_3, data_2=merge, data_3=merge_2, data_4=merge_4, F=db0_scale_extforce)  # -> line, col, num, S
gm1_formdiagram = ClusterOutput(visualization.line)
cl1_formdiagram = ClusterOutput(visualization.col)
db0_forcemagn = ClusterOutput(visualization.num)
pt1_formnode = ClusterOutput(visualization.S)
str1_nodeorderout = ClusterOutput(cem.str1_NodeOrderOut)

# ==== cluster Cluster_3
num = ClusterInput()
int = ClusterInput()
num_2 = ClusterInput()
centr = ClusterInput()
ring2 = ClusterInput()
pt = ClusterInput()
ring_1 = ClusterInput()
num_3 = Number(num)
int_2 = Integer(int)
num_4 = Number(num_2)
centr_2 = Curve(centr)
ring2_2 = Curve(ring2)
pt_2 = Point(pt)
ring_1_2 = Curve(ring_1)
int_3 = Number(int_2)
yz = YZPlane(Origin=Point(0, 0, 0))
crv = ClusterInput()
pln = Plane(yz)
deplane = DeconstructPlane(Plane=pln)  # -> Origin, XAxis, YAxis, ZAxis
X = UnitX(Factor=num_4)
rev = Reverse(Vector=X)
crv_2 = Curve(crv)
move = Move(Geometry=pt_2, Motion=X)  # -> Geometry, Transform
move_2 = Move(Geometry=pt_2, Motion=rev)  # -> Geometry, Transform
pl = ConstructPlane(Origin=move.Geometry, XAxis=deplane.XAxis, YAxis=deplane.YAxis)
pl_2 = ConstructPlane(Origin=move_2.Geometry, XAxis=deplane.XAxis, YAxis=deplane.YAxis)
pln_2 = Plane(pl)
pln_3 = Plane(pl_2)
pcx = CurvePlane(Curve=ring_1_2, Plane=pln_2)  # -> Points, ParamsC, ParamsP
pcx_2 = CurvePlane(Curve=ring2_2, Plane=pln_2)  # -> Points, ParamsC, ParamsP
pcx_3 = CurvePlane(Curve=ring_1_2, Plane=pln_3)  # -> Points, ParamsC, ParamsP
pcx_4 = CurvePlane(Curve=ring2_2, Plane=pln_3)  # -> Points, ParamsC, ParamsP
pcx_5 = CurvePlane(Curve=crv_2, Plane=pln_2)  # -> Points, ParamsC, ParamsP
pcx_6 = CurvePlane(Curve=crv_2, Plane=pln_3)  # -> Points, ParamsC, ParamsP
shatter = Shatter(Curve=ring_1_2, Parameters=pcx.ParamsC)
shatter_2 = Shatter(Curve=ring2_2, Parameters=pcx_2.ParamsC)
item = ListItem(List=pcx.ParamsC, Index=1, Wrap=True)
eval = EvaluateCurve(Curve=reparameterize(centr_2), Parameter=Slider(0.5, range=0..1))  # -> Point, Tangent, Angle
shatter_3 = Shatter(Curve=ring_1_2, Parameters=pcx_3.ParamsC)
shatter_4 = Shatter(Curve=ring2_2, Parameters=pcx_4.ParamsC)
item_2 = ListItem(List=pcx_2.ParamsC, Index=1, Wrap=True)
shatter_5 = Shatter(Curve=crv_2, Parameters=pcx_5.ParamsC)
item_3 = ListItem(List=pcx_5.ParamsC, Index=1, Wrap=True)
shatter_6 = Shatter(Curve=crv_2, Parameters=pcx_6.ParamsC)
fsim = FindSimilarMember(Data=item, Set=pcx_3.ParamsC)  # -> Hit, Index
fsim_2 = FindSimilarMember(Data=item_2, Set=pcx_4.ParamsC)  # -> Hit, Index
scale = Scale(Geometry=centr_2, Center=eval.Point, Factor=num_3)  # -> Geometry, Transform
item_4 = ListItem(List=shatter, Index=0, Wrap=True)
item_5 = ListItem(List=shatter_3, Index=fsim.Index, Wrap=True)
fsim_3 = FindSimilarMember(Data=item_3, Set=pcx_6.ParamsC)  # -> Hit, Index
item_6 = ListItem(List=shatter_2, Index=0, Wrap=True)
item_7 = ListItem(List=shatter_4, Index=fsim_2.Index, Wrap=True)
item_8 = ListItem(List=shatter_5, Index=0, Wrap=True)
item_9 = ListItem(List=shatter_6, Index=fsim_3.Index, Wrap=True)
flip = FlipCurve(Curve=item_7)  # -> Curve, Flag
flip_2 = FlipCurve(Curve=item_6)  # -> Curve, Flag
divide = DivideCurve(Curve=item_5, Count=int_3, Kinks=False)  # -> Points, Tangents, Parameters
divide_2 = DivideCurve(Curve=flip_2.Curve, Count=int_3, Kinks=False)  # -> Points, Tangents, Parameters
divide_3 = DivideCurve(Curve=scale.Geometry, Count=int_3, Kinks=False)  # -> Points, Tangents, Parameters
divide_4 = DivideCurve(Curve=item_4, Count=int_3, Kinks=False)  # -> Points, Tangents, Parameters
divide_5 = DivideCurve(Curve=flip.Curve, Count=int_3, Kinks=False)  # -> Points, Tangents, Parameters
divide_6 = DivideCurve(Curve=item_9, Count=int_3, Kinks=False)  # -> Points, Tangents, Parameters
divide_7 = DivideCurve(Curve=item_8, Count=int_3, Kinks=False)  # -> Points, Tangents, Parameters
rev_2 = ReverseList(List=divide_7.Points)
rev_3 = ReverseList(List=divide.Points)
rev_4 = ReverseList(List=divide_3.Points)
rev_5 = ReverseList(List=divide_5.Points)
pt_3 = Point([divide_7.Points, divide_6.Points])
line = LineSDL(Start=pt_3, Direction=Vector(0, 0, 1), Length=1)
ln = Line(StartPoint=divide_2.Points, EndPoint=rev_5)
rev_6 = ReverseList(List=divide_6.Points)
ln_2 = Line(StartPoint=divide_4.Points, EndPoint=divide_2.Points)
pline = PolyLine(Vertices=divide_2.Points, Closed=False)
pline_2 = PolyLine(Vertices=divide_5.Points, Closed=False)
pline_3 = PolyLine(Vertices=divide_3.Points, Closed=False)
pline_4 = PolyLine(Vertices=divide.Points, Closed=False)
pline_5 = PolyLine(Vertices=divide_4.Points, Closed=False)
ln_3 = Line(StartPoint=divide_4.Points, EndPoint=rev_3)
ln_4 = Line(StartPoint=divide_3.Points, EndPoint=divide_5.Points)
ln_5 = Line(StartPoint=divide.Points, EndPoint=divide_5.Points)
ln_6 = Line(StartPoint=divide.Points, EndPoint=divide_3.Points)
ln_7 = Line(StartPoint=rev_4, EndPoint=divide_4.Points)
ln_8 = Line(StartPoint=divide_2.Points, EndPoint=rev_4)
ln_9 = Line(StartPoint=divide_5.Points, EndPoint=divide_7.Points)
ln_10 = Line(StartPoint=divide_2.Points, EndPoint=divide_6.Points)
ln_11 = Line(StartPoint=divide_4.Points, EndPoint=divide_6.Points)
ln_12 = Line(StartPoint=divide.Points, EndPoint=divide_7.Points)
end = EndPoints(Curve=pline_3)  # -> Start, End
end_2 = EndPoints(Curve=centr_2)  # -> Start, End
end_3 = EndPoints(Curve=[pline_5, pline_2, pline_4, pline])  # -> Start, End
explode = Explode(Curve=pline_3, Recursive=True)  # -> Segments, Vertices
explode_2 = Explode(Curve=pline_2, Recursive=True)  # -> Segments, Vertices
explode_3 = Explode(Curve=pline, Recursive=True)  # -> Segments, Vertices
explode_4 = Explode(Curve=pline_4, Recursive=True)  # -> Segments, Vertices
explode_5 = Explode(Curve=pline_5, Recursive=True)  # -> Segments, Vertices
ln_13 = Line(StartPoint=end.Start, EndPoint=end_2.Start)
ln_14 = Line(StartPoint=end.End, EndPoint=end_2.End)
cull_i = CullIndex(List=explode.Segments, Indices=expr("(x-1)/2", int_3), Wrap=True)
cull_i_2 = CullIndex(List=explode_2.Segments, Indices=expr("(x-1)/2", int_3), Wrap=True)
item_10 = ListItem(List=explode_2.Segments, Index=expr("(x-1)/2", int_3), Wrap=True)
cull_i_3 = CullIndex(List=explode_3.Segments, Indices=expr("(x-1)/2", int_3), Wrap=True)
item_11 = ListItem(List=explode_4.Segments, Index=expr("(x-1)/2", int_3), Wrap=True)
item_12 = ListItem(List=explode_3.Segments, Index=expr("(x-1)/2", int_3), Wrap=True)
cull_i_4 = CullIndex(List=explode_4.Segments, Indices=expr("(x-1)/2", int_3), Wrap=True)
cull_i_5 = CullIndex(List=explode_5.Segments, Indices=expr("(x-1)/2", int_3), Wrap=True)
item_13 = ListItem(List=explode_5.Segments, Index=expr("(x-1)/2", int_3), Wrap=True)
item_14 = ListItem(List=explode.Segments, Index=expr("(x-1)/2", int_3), Wrap=True)
pt_4 = Point([divide_2.Points, divide_5.Points])
pt_5 = Point([divide_4.Points, divide.Points])
dev_ring1_ring1 = Line(ln_3)
dev_ring2_ring2 = Line(ln)
perimeter_of_bowl = Line(line)
dev_1_centr = Line(ln_6)
dev_1_centr_2 = Line(ln_7)
line_2 = Line(cull_i_3)
line_3 = Line(cull_i_4)
line_4 = Line(cull_i_5)
line_5 = Line(cull_i_2)
line_6 = Line(cull_i)
line_7 = Line(ln_14)
line_8 = Line(item_10)
int_4 = Integer(int_3)
line_9 = Line(ln_13)
line_10 = Line(item_12)
line_11 = Line(item_14)
line_12 = Line(item_11)
line_13 = Line(item_13)
dev_2_bowl = Line(ln_10)
dev_2_bowl_2 = Line(ln_9)
dev_2_centr = Line(ln_8)
dev_2_cent = Line(ln_4)
supportpt = Point(flatten([end_2.End, end_3.Start, end_3.End, end_2.Start]))
dev_1_bowl = Line(ln_12)
pt_6 = ClusterOutput(pt_4)
dev_1_bowl_2 = Line(ln_11)
pt_7 = ClusterOutput(pt_5)
dev_1_2 = Line(ln_2)
dev_1_2_2 = Line(ln_5)
line_14 = ClusterOutput(line_2)
line_15 = ClusterOutput(line_3)
line_16 = ClusterOutput(line_4)
line_17 = ClusterOutput(line_5)
line_18 = ClusterOutput(line_6)
line_19 = ClusterOutput(line_7)
line_20 = ClusterOutput(line_8)
int_5 = ClusterOutput(int_4)
line_21 = ClusterOutput(line_9)
line_22 = ClusterOutput(line_10)
line_23 = ClusterOutput(line_11)
line_24 = ClusterOutput(line_12)
line_25 = ClusterOutput(line_13)
dev_ring1_ring1_2 = ClusterOutput(dev_ring1_ring1)
dev_ring2_ring2_2 = ClusterOutput(dev_ring2_ring2)
perimeter_of_bowl_2 = ClusterOutput(perimeter_of_bowl)
dev_1_centr_3 = Line(dev_1_centr_2)
dev_1_bowl_3 = ClusterOutput(dev_1_bowl)
dev_1_centr_4 = Line(dev_1_centr)
dev_1_bowl_4 = ClusterOutput(dev_1_bowl_2)
dev_2_centr_2 = Line(dev_2_centr)
supportpt_2 = ClusterOutput(supportpt)
dev_2_cent_2 = Line(dev_2_cent)
dev_1_2_3 = Line(dev_1_2_2)
dev_1_2_4 = Line(dev_1_2)
dev_2_bowl_3 = Line(dev_2_bowl)
dev_2_bowl_4 = Line(dev_2_bowl_2)
dev_1_centr_5 = ClusterOutput(dev_1_centr_3)
dev_1_centr_6 = ClusterOutput(dev_1_centr_4)
dev_2_centr_3 = ClusterOutput(dev_2_centr_2)
dev_2_cent_3 = ClusterOutput(dev_2_cent_2)
dev_1_2_5 = ClusterOutput(dev_1_2_3)
dev_1_2_6 = ClusterOutput(dev_1_2_4)
dev_2_bowl_5 = ClusterOutput(dev_2_bowl_3)
dev_2_bowl_6 = ClusterOutput(dev_2_bowl_4)

# ==== cluster Cluster_4
perimeter_of_bowl = ClusterInput()
devinitial_trail_centrline = ClusterInput()
num = ClusterInput()
att_trail_ring1 = ClusterInput()
devinitial_trail_ring2 = ClusterInput()
devinitial_trail_ring1 = ClusterInput()
att_trail_ring2 = ClusterInput()
trail_ring1 = ClusterInput()
trail_ring2 = ClusterInput()
num_2 = ClusterInput()
trail_centrline = ClusterInput()
num_3 = ClusterInput()
num_4 = ClusterInput()
num_5 = ClusterInput()
txt = ClusterInput()
line = ClusterInput()
perimeter_of_bowl_2 = Line(perimeter_of_bowl)
devinitial_trail_centrline_2 = Line(devinitial_trail_centrline)
num_6 = Number(num)
att_trail_ring1_2 = Number(att_trail_ring1)
devinitial_trail_ring2_2 = Line(devinitial_trail_ring2)
devinitial_trail_ring1_2 = Line(devinitial_trail_ring1)
att_trail_ring2_2 = Number(att_trail_ring2)
trail_ring1_2 = Line(trail_ring1)
trail_ring2_2 = Line(trail_ring2)
num_7 = Number(num_2)
trail_centrline_2 = Line(trail_centrline)
att_dev_1_centr = ClusterInput()
att_dev_2_centr = ClusterInput()
num_8 = Number(num_3)
att_dev_2_centr_2 = ClusterInput()
num_9 = Number(num_4)
dev_2_centr = ClusterInput()
att_dev_1_centr_2 = ClusterInput()
dev_1_centr = ClusterInput()
dev_2_centr_2 = ClusterInput()
num_10 = Number(num_5)
dev_1_centr_2 = ClusterInput()
txt_2 = Text(txt)
line_2 = Line(line)
att_dev_1_2 = ClusterInput()
att_dev_1_2_2 = ClusterInput()
dev_1_2 = ClusterInput()
dev_1_2_2 = ClusterInput()
dev_ring1_ring1 = ClusterInput()
dev_ring2_ring2 = ClusterInput()
att_dev_1_centr_3 = Data(att_dev_1_centr)
att_dev_2_centr_3 = Data(att_dev_2_centr)
att_dev_2_centr_4 = Data(att_dev_2_centr_2)
data = ClusterInput()
dev_2_centr_3 = Line(dev_2_centr)
att_dev_1_centr_4 = Data(att_dev_1_centr_2)
dev_1_centr_3 = Line(dev_1_centr)
dev_2_centr_4 = Line(dev_2_centr_2)
dev_1_centr_4 = Line(dev_1_centr_2)
data_2 = ClusterInput()
dev_2_bowl = ClusterInput()
att_dev_1_2_3 = Data(att_dev_1_2)
att_dev_1_2_4 = Data(att_dev_1_2_2)
dev_1_2_3 = Line(dev_1_2)
dev_2_bowl_2 = ClusterInput()
dev_2_bowl_3 = ClusterInput()
dev_2_bowl_4 = ClusterInput()
dev_1_bowl = ClusterInput()
dev_1_2_4 = Line(dev_1_2_2)
dev_1_bowl_2 = ClusterInput()
dev_1_bowl_3 = ClusterInput()
dev_1_bowl_4 = ClusterInput()
dev_ring1_ring1_2 = Line(dev_ring1_ring1)
dev_ring2_ring2_2 = Line(dev_ring2_ring2)
data_3 = Data(data)
data_4 = Data(data_2)
dev_2_bowl_5 = Data(dev_2_bowl)
dev_2_bowl_6 = Line(dev_2_bowl_2)
dev_2_bowl_7 = Line(dev_2_bowl_3)
dev_2_bowl_8 = Data(dev_2_bowl_4)
dev_1_bowl_5 = Data(dev_1_bowl)
dev_1_bowl_6 = Line(dev_1_bowl_2)
dev_1_bowl_7 = Line(dev_1_bowl_3)
dev_1_bowl_8 = Data(dev_1_bowl_4)
merge = Merge(Data1=devinitial_trail_ring1_2, Data2=devinitial_trail_ring2_2, Data3=devinitial_trail_centrline_2)
merge_2 = Merge(Data1=num_8, Data2=num_9, Data3=num_7)
merge_3 = Merge(Data1=trail_ring1_2, Data2=trail_ring2_2, Data3=trail_centrline_2, Data4=perimeter_of_bowl_2)
merge_4 = Merge(Data1=att_trail_ring1_2, Data2=att_trail_ring2_2, Data3=num_10, Data4=num_6)
B = ClusterInput()
support = ClusterInput()
support_2 = Point(flatten(support))
support_3 = ClusterOutput(support_2)
txt_3 = Text(flatten(merge_4))
trails = Curve(flatten(merge_3))
txt_4 = Text(flatten(txt_2))
external_force = Curve(flatten(line_2))
merge_5 = Merge(
    Data1=att_dev_1_2_4,
    Data2=att_dev_1_2_3,
    Data3=att_dev_2_centr_3,
    Data4=att_dev_2_centr_4,
    Data5=att_dev_1_centr_3,
    Data6=att_dev_1_centr_4,
    Data7=data_4,
    Data8=data_3,
    Data9=dev_1_bowl_5,
    Data10=dev_1_bowl_8,
    Data11=dev_2_bowl_5,
    Data12=dev_2_bowl_8)
division = Division(A=flatten(merge_5), B=B)
multiplication = Multiplication(A=division, B=20)
merge_6 = Merge(Data1=flatten(merge_2), Data2=flatten(multiplication))
merge_7 = Merge(
    Data1=dev_1_2_4,
    Data2=dev_1_2_3,
    Data3=dev_2_centr_4,
    Data4=dev_2_centr_3,
    Data5=dev_1_centr_3,
    Data6=dev_1_centr_4,
    Data7=dev_ring1_ring1_2,
    Data8=dev_ring2_ring2_2,
    Data9=dev_1_bowl_6,
    Data10=dev_1_bowl_7,
    Data11=dev_2_bowl_6,
    Data12=dev_2_bowl_7)
merge_8 = Merge(Data1=flatten(merge), Data2=flatten(merge_7))
txt_5 = ClusterOutput(txt_3)
trails_2 = ClusterOutput(trails)
txt_6 = ClusterOutput(txt_4)
external_force_2 = ClusterOutput(external_force)
line_3 = Line(merge_8)
data_5 = Data(merge_6)
deviation = Curve(flatten(line_3))
txt_7 = Text(flatten(data_5))
txt_8 = ClusterOutput(txt_7)
deviation_2 = ClusterOutput(deviation)

# ==== cluster PlanesGroundLevelSupports
O = ClusterInput()
L = ClusterInput()
xy = XYPlane(Origin=O)
lng = ListLength(List=L)
dup = DuplicateData(Data=xy, Number=lng, Order=True)
series = Series(Start=0, Step=1, Count=lng)
L_2 = ClusterInput()
replace = ReplaceItems(List=reverse(L_2), Item=dup, Indices=series, Wrap=False)
rev = ReverseList(List=replace)
L_3 = ClusterOutput(rev)

# ==== cluster GroundLevelSupports
pt_groundlevel = ClusterInput()
int = ClusterInput()
data = ClusterInput()
pt_groundlevel_2 = Point(pt_groundlevel)
int_2 = Integer(int)
data_2 = Data(data)
lng = ListLength(List=data_2)
xy = XYPlane(Origin=pt_groundlevel_2)
split = SplitList(List=reverse(int_2), Index=lng)  # -> ListA, ListB
dup = DuplicateData(Data=xy, Number=lng, Order=True)
A = ClusterOutput(split.ListA)
D = ClusterOutput(dup)

# ==== cluster Visualization
data = ClusterInput()
data_2 = ClusterInput()
data_3 = ClusterInput()
data_4 = ClusterInput()
F = ClusterInput()
data_5 = Data(data)
data_6 = Data(data_2)
data_7 = Data(data_3)
data_8 = Data(data_4)
cluster = Cluster_2(data=data_8)  # -> line_2, col_2, num_2
cluster_2 = Cluster_2(data=data_5)  # -> line_2, col_2, num_2
cluster_3 = Cluster_2(data=data_6)  # -> line_2, col_2, num_2
cluster_4 = Cluster_2(data=data_7)  # -> line_2, col_2, num_2
end = EndPoints(Curve=flatten(cluster_3.line_2))  # -> Start, End
end_2 = EndPoints(Curve=cluster.line_2)  # -> Start, End
scale = Scale(Geometry=cluster.line_2, Center=end_2.Start, Factor=F)  # -> Geometry, Transform
col = ClusterOutput([cluster_2.col_2, cluster_3.col_2, cluster_4.col_2, cluster.col_2])
num = ClusterOutput([cluster_2.num_2, cluster_3.num_2, cluster_4.num_2, cluster.num_2])
S = ClusterOutput(end.Start)
line = ClusterOutput([cluster_2.line_2, cluster_3.line_2, cluster_4.line_2, scale.Geometry])

# ==== cluster Cluster_2
data = ClusterInput()
data_2 = Data(data)
item = ListItem(List=data_2, Index=0, Wrap=True)
item_2 = ListItem(List=data_2, Index=1, Wrap=True)
item_3 = ListItem(List=data_2, Index=2, Wrap=True)
line = Line(flatten(item))
col = Colour(flatten(item_2))
num = Number(flatten(item_3))
line_2 = ClusterOutput(line)
col_2 = ClusterOutput(col)
num_2 = ClusterOutput(num)
